# Grasshopper definition Kinect integration.gh (Grasshopper 0.9.76)
# plug-ins: Python Interpreter, Firefly.Kinect.V2, PTComponentLibrary

skeleton = KinectV2SkeletonTracker(StartSkeletonTracker=True)  # -> Joints, JointIDs, Bones; disabled
scale = Scale(Geometry=skeleton.Joints, Center=Point(0, 0, 0), Factor=Slider(100, range=0..100))  # -> Geometry, Transform
group = Group(Objects=scale.Geometry)
number_slider = Slider(11, range=0..11)
number_slider_2 = Slider(7, range=0..11)
rec = DataRecorder(group, DataLimit=-10, RecordData=False)
item = ListItem(List=[null x290], Index=Slider(6, range=0..289), Wrap=True)
geo = Geometry(item)
panel = Panel(rec)
total_length_in = Slider(54, range=0..96)
total_height_in = Slider(73, range=0..96)
division = Division(A=number_slider_2, B=2)
number_slider_3 = Slider(13, range=0..20)
division_2 = Division(A=number_slider, B=2)
number_slider_4 = Slider(15, range=0..24)
scale_2 = Scale(Geometry=geo, Center=Point(0, 0, 0), Factor=Slider(0.402, range=0..1))  # -> Geometry, Transform
Z = UnitZ(Factor=Slider(32, range=0..96))
move = Move(Geometry=scale_2.Geometry, Motion=Z)  # -> Geometry, Transform
X = UnitX(Factor=Slider(10, range=0..96))
move_2 = Move(Geometry=move.Geometry, Motion=expr("-x", X))  # -> Geometry, Transform
division_3 = Division(A=total_height_in, B=number_slider_3)
division_4 = Division(A=total_length_in, B=number_slider_4)
Z_2 = UnitZ(Factor=1)
X_2 = UnitX(Factor=1)
ungroup = Ungroup(Group=move_2.Geometry)
item_2 = ListItem(List=ungroup, Index=Slider(0, range=0..24), Wrap=True)
X_3 = UnitX(Factor=1)
rad = Radians(Degrees=Slider(0, range=-90..0))
ptplanar = PlanarGrid(
    BasePoint=Point(0, 0, 0),
    IDir=Z_2,
    JDir=X_2,
    IDistance=division_4,
    JDistance=division_3,
    INumber=number_slider_4,
    JNumber=number_slider_3)
rot3d = Rotate3D(Geometry=ungroup, Angle=rad, Center=item_2, Axis=X_3)  # -> Geometry, Transform
pttodiamond = ConvertToDiamond(Grid=ptplanar)
culln = CullNth(List=flatten(ptplanar), CullFrequency=2)
ptfaces = GenerateFaces(Grid=pttodiamond, PanelShape=0)  # -> simplify(Faces)
item_3 = ListItem(List=rot3d.Geometry, Index=7, Wrap=True)
item_4 = ListItem(List=rot3d.Geometry, Index=3, Wrap=True)
item_5 = ListItem(List=rot3d.Geometry, Index=11, Wrap=True)
item_6 = ListItem(List=rot3d.Geometry, Index=19, Wrap=True)
item_7 = ListItem(List=rot3d.Geometry, Index=15, Wrap=True)
xz = XZPlane(Origin=culln)
area = Area(Geometry=ptfaces)  # -> Area, Centroid
geo_2 = Geometry(flatten(ptfaces))
Z_3 = UnitZ(Factor=1)
rectangle = Rectangle(Plane=xz, XSize=number_slider_2, YSize=number_slider, Radius=0)  # -> Rectangle, Length
item_8 = ListItem(List=geo_2, Index=0, Wrap=True)
intcrv = Interpolate(Vertices=[item_3, item_4, item_5, item_6, item_7], Degree=3, Periodic=True, KnotStyle=1)  # -> Curve, Length, Domain
edges = BrepEdges(Brep=rectangle.Rectangle)  # -> Naked, Interior, NonManifold
multiplication = Multiplication(A=division_2, B=Z_3)
xz_2 = XZPlane(Origin=Point(0, 0, 0))
X_4 = UnitX(Factor=1)
project = Project(Geometry=intcrv.Curve, Plane=xz_2)  # -> Geometry, Transform
divide = DivideCurve(Curve=edges.Naked, Count=Slider(2, range=0..2), Kinks=False)  # -> Points, Tangents, Parameters
move_3 = Move(Geometry=culln, Motion=multiplication)  # -> simplify(flatten(Geometry)), Transform
multiplication_2 = Multiplication(A=division, B=X_4)
item_9 = ListItem(List=simplify(divide.Points), Index=1, Wrap=True)
move_4 = Move(Geometry=move_3.Geometry, Motion=multiplication_2)  # -> Geometry, Transform
topoly = CurveToPolyline(Curve=project.Geometry, ToleranceDistance=0, ToleranceAngle=0)  # -> Polyline, Segments
pshift = ShiftPaths(Data=item_9, Offset=-1)
points = PointList(Points=move_4.Geometry)
pcen = PolygonCenter(Polyline=topoly.Polyline)  # -> CenterV, CenterE, CenterA
intcrv_2 = Interpolate(Vertices=pshift, Degree=1, Periodic=True, KnotStyle=1)  # -> Curve, Length, Domain
geo_3 = Geometry(pcen.CenterE)
geo_4 = Geometry(pcen.CenterV)
boundary = BoundarySurfaces(Edges=intcrv_2.Curve)  # -> flatten(Surfaces)
X_5 = UnitX(Factor=1)
move_5 = Move(Geometry=boundary, Motion=expr("x*-30", X_5))  # -> Geometry, Transform
move_6 = Move(Geometry=move_4.Geometry, Motion=expr("x*-30", X_5))  # -> Geometry, Transform
incurve = PointInCurve(Point=move_6.Geometry, Curve=project.Geometry)  # -> Relationship, Point
dispatch = Dispatch(List=move_5.Geometry, DispatchPattern=incurve.Relationship)  # -> ListA, ListB
geo_5 = Geometry(dispatch.ListA)
area_2 = Area(Geometry=move_5.Geometry)  # -> Area, Centroid
index = ItemIndex(List=move_5.Geometry, Item=dispatch.ListA)
area_3 = Area(Geometry=geo_5)  # -> Area, Centroid
geo_6 = Geometry(dispatch.ListB)
area_4 = Area(Geometry=geo_5)  # -> Area, Centroid
vec2pt = Vector2Pt(PointA=area_3.Centroid, PointB=geo_3, Unitize=False)  # -> Vector, Length
points_2 = PointList(Points=area_2.Centroid, Size=Slider(2.013, range=0..5))
devec = DeconstructVector(Vector=vec2pt.Vector)  # -> XComponent, YComponent, ZComponent
vec2pt_2 = Vector2Pt(PointA=area_4.Centroid, PointB=geo_3, Unitize=False)  # -> Vector, Length
dist = Distance(PointA=geo_3, PointB=area_3.Centroid)
addition = Addition(A=devec.XComponent, B=devec.ZComponent)
number = Number(-1)
_1 = Number(1)
devec_2 = DeconstructVector(Vector=vec2pt_2.Vector)  # -> XComponent, YComponent, ZComponent
bnd = Bounds(Numbers=flatten(devec.XComponent))
number_2 = Number(-1)
dom = ConstructDomain(DomainStart=number, DomainEnd=_1)
_1_2 = Number(1)
bnd_2 = Bounds(Numbers=flatten(devec_2.XComponent))
dom_2 = ConstructDomain(DomainStart=number_2, DomainEnd=_1_2)
remap = RemapNumbers(Value=devec.XComponent, Source=bnd, Target=dom)  # -> Mapped, Clipped
_90 = Number(90)
number_3 = Number(-90)
dist_2 = Distance(PointA=geo_3, PointB=area_4.Centroid)
remap_2 = RemapNumbers(Value=devec_2.XComponent, Source=bnd_2, Target=dom_2)  # -> Mapped, Clipped
multiplication_3 = Multiplication(A=remap.Mapped, B=dist)
_1_3 = Number(1)
_0 = Number(0)
dom_3 = ConstructDomain(DomainStart=number_3, DomainEnd=_90)
multiplication_4 = Multiplication(A=remap_2.Mapped, B=dist_2)
bnd_3 = Bounds(Numbers=flatten(multiplication_3))
bnd_4 = Bounds(Numbers=flatten(multiplication_4))
dom_4 = ConstructDomain(DomainStart=_0, DomainEnd=_1_3)
_650 = Number(650)
_2300 = Number(2300)
_1500 = Number(1500)
_98 = Number(98)
remap_3 = RemapNumbers(Value=multiplication_3, Source=bnd_3, Target=dom_3)  # -> Mapped, Clipped
dom_5 = ConstructDomain(DomainStart=_650, DomainEnd=_2300)
remap_4 = RemapNumbers(Value=multiplication_4, Source=bnd_4, Target=dom_4)  # -> Mapped, Clipped
dup = DuplicateData(Data=_1500, Number=_98, Order=True)
subtraction = Subtraction(A=1, B=remap_4.Mapped)
bnd_5 = Bounds(Numbers=flatten(subtraction))
remap_5 = RemapNumbers(Value=subtraction, Source=bnd_5, Target=dom_5)  # -> Mapped, Clipped
subtraction_2 = Subtraction(A=90, B=remap_3.Mapped)
replace = ReplaceItems(List=dup, Item=remap_5.Mapped, Indices=index, Wrap=False)
Z_4 = UnitZ(Factor=1)
subtraction_3 = Subtraction(A=_1500, B=remap_5.Mapped)
rad_2 = Radians(Degrees=subtraction_2)
panel_2 = Panel(subtraction_2)
panel_3 = Panel(replace)
panel_4 = Panel(subtraction)
rot3d_2 = Rotate3D(Geometry=geo_5, Angle=rad_2, Center=area_3.Centroid, Axis=Z_4)  # -> Geometry, Transform
panel_5 = Panel(incurve.Relationship)
round = Round(Number=replace)  # -> Nearest, Floor, Ceiling
preview = CustomPreview(Geometry=[rot3d_2.Geometry, geo_6], Shader=ColourSwatch(SwatchColor=RGBA(242, 244, 252, 214)))
panel_6 = Panel(round.Nearest)
number_slider_5 = Slider(1000, range=0..1000)
number_slider_6 = Slider(98, range=0..98)
round_2 = Round(Acceleration=Slider(8, range=1..255))  # -> Acceleration, Floor, Ceiling
round_3 = Round(Angle_us=Slider(1500, range=544..2336))  # -> Angle_us, Floor, Ceiling
round_4 = Round(Number=Slider(2, range=1..250))  # -> Nearest, Floor, Ceiling
open_port = PythonScript(baudrate=Slider(112500, range=0..112500), port="COM4", open=Toggle(False))  # -> out, a
# ---------- open_port: Python ----------
import serial
import scriptcontext

SCS = scriptcontext.sticky
K = 'serialport'

if K in SCS:
    myPort=SCS[K]
else:
    myPort=serial.Serial()
    
if open == True:
    try:
        myPort.baudrate = baudrate
        myPort.port = port
        myPort.open()
        SCS[K] = myPort
    except:
        print "Something went wrong. Cannot open port."
    if myPort.isOpen() == True:
        print myPort.name + " is open"
        
if open != True:
    try:
        myPort.close()
    except:
        print "Something went wrong. Cannot close port."
    if myPort.isOpen != True:
        print "Port is closed"
# ---------- end open_port ----------
boards_off = Slider(1, range=0..1)
dup_2 = DuplicateData(Data=round_4.Nearest, Number=number_slider_6, Order=True)
dup_3 = DuplicateData(Data=round_3.Angle_us, Number=number_slider_6, Order=True)
panel_7 = Panel(open_port.out)
servo_control = PythonScript(speed_val=dup_2, angle_us1=round.Nearest, boards_off=boards_off)  # -> out, a; inputs speed_val: list, angle_us1: list
# ---------- servo_control: Python ----------
import serial
import scriptcontext
import base64

myPort = scriptcontext.sticky['serialport']
myPort.flushInput()
myPort.flushOutput()

ghSpeedsList = []
board0speeds = []
board1speeds = []
board2speeds = []
board3speeds = []
board4speeds = []

ghTargetsList = []
board0targets = []
board1targets = []
board2targets = []
board3targets = []
board4targets = []

print speed_val
print angle_us1

class Controller:
    
    def __init__(self, device_number = 0x00):
        # Define the object as the already open port
        self.usb = myPort
        # Command lead-in and device number are sent for each Pololu serial commands.
        self.PololuCmd = [0xaa, device_number]
     
    def setTargets(self, num_targets, start_chan = 0x00, *targets):

        pairList = list(targets)
        valueList = []
        cmdSplitList = []

        for pair in pairList:
            valueList.append(pair[1])
        #print valueList

        qValueList = [us*4 for us in valueList]
        #print qValueList

        for value in qValueList:
            lsb = value & 0x7f #7 bits for least significant byte
            msb = (value >> 7) & 0x7f #shift 7 and take next 7 bits for msb
            cmdSplitList.append(lsb)
            cmdSplitList.append(msb)
        #print cmdSplitList

        # Send Pololu intro, device number, multiple targets command, number of targets, start channel, and targets lsb/msb
        multi_target_cmd = [0x1F, num_targets, start_chan]
        cmd_intro = self.PololuCmd + multi_target_cmd
        cmd = cmd_intro + cmdSplitList
        #print cmd
        return cmd
        # self.usb.write(bytes(bytearray(cmd)))
        # myPort.write(bytes(bytearray(cmd)))
        # # Record Target value
        # self.Targets[chan] = target
        
    # Set speeds for all used channels on each board
    # Speed is measured as 0.25microseconds/10milliseconds
    # For the standard 1ms pulse width change to move a servo between extremes, a speed
    # of 1 will take 1 minute, and a speed of 60 would take 1 second.
    # Speed of 0 is unrestricted.
    def setSpeeds(self, *speeds):
        
        pairList = list(speeds)
        valueList = []
        cmdSplitList = []
        speed_cmd = []

        for pair in pairList:
            valueList.append(pair[1])
        #print valueList

        qValueList = [us*4 for us in valueList]

        # Send Pololu intro, device number, command, channel, and target lsb/msb
        for chan, value in enumerate(qValueList):
            lsb = value & 0x7f #7 bits for least significant byte
            msb = (value >> 7) & 0x7f #shift 7 and take next 7 bits for msb
            set_speed_cmd = [0x07, chan, lsb, msb]
            cmd = self.PololuCmd + set_speed_cmd
            speed_cmd = speed_cmd + cmd
        # print speed_cmd
        return speed_cmd
            # print cmd

            # self.usb.write(bytes(bytearray(cmd)))
            # myPort.write(bytes(bytearray(cmd)))
        

    # Set acceleration of channel
    # This provide soft starts and finishes when servo moves to target position.
    # Valid values are from 0 to 255. 0=unrestricted, 1 is slowest start.
    # A value of 1 will take the servo about 3s to move between 1ms to 2ms range.
    def setAccel(self, chan, accel):
        pass
        # lsb = accel & 0x7f #7 bits for least significant byte
        # msb = (accel >> 7) & 0x7f #shift 7 and take next 7 bits for msb
        # # Send Pololu intro, device number, command, channel, accel lsb, accel msb
        # cmd = self.PololuCmd + chr(0x09) + chr(chan) + chr(lsb) + chr(msb)
        # self.usb.write(bytes(bytearray(cmd)))
    

    def getMovingState(self):
        intro_cmd = self.PololuCmd
        moving = [0x13]
        cmd = intro_cmd + moving
        # print cmd
        self.usb.write(bytes(bytearray(cmd)))
        # myPort.write(bytes(bytearray(cmd)))
        # workaround to make the speed and target assignment to run since the reads are not returning anything
        # return False
        response = self.usb.read()
        # response = myPort.read()
        print (base64.b16encode(response) + "\n")
        if response == chr(0):
            return False
        else:
            return True

# the parsing functions create the arrays of speeds and targets used for each board
# both functions take a list of 98 values which is the number of servos used in the project
# in the full version of the program the lists are generated dynamically - target values for the 98 servos will generally be all different, speeds may or may not be different
def parseSpeeds(*ghSpeeds):
    global ghSpeedsList, board0speeds, board1speeds, board2speeds, board3speeds, board4speeds
    parsedSpeeds = [0]*2

    ghSpeedsList = list(ghSpeeds)
    #print ghSpeedsList
    board0speeds = []
    board1speeds = []
    board2speeds = []
    board3speeds = []
    board4speeds = []

    for index, speed in enumerate(ghSpeedsList):
        if index < 20:
            parsedSpeeds[0] = 0x00
            parsedSpeeds[1] = speed
            board0speeds.append(parsedSpeeds)
            #print board0speeds
        elif index > 19 and index < 39:
            parsedSpeeds[0] = 0x01
            parsedSpeeds[1] = speed
            board1speeds.append(parsedSpeeds)
        elif index > 38 and index < 59:
            parsedSpeeds[0] = 0x02
            parsedSpeeds[1] = speed
            board2speeds.append(parsedSpeeds)
        elif index > 58 and index < 78:
            parsedSpeeds[0] = 0x03
            parsedSpeeds[1] = speed
            board3speeds.append(parsedSpeeds)
        elif index > 77 and index < 98:
            parsedSpeeds[0] = 0x04
            parsedSpeeds[1] = speed
            board4speeds.append(parsedSpeeds)
        else:
            print "Invalid speed index."

def parseTargets(*ghTargets):
    global ghTargetsList, board0targets, board1targets, board2targets, board3targets, board4targets
    parsedTargets = [0]*2

    ghTargetsList = list(ghTargets)
    #print ghTargetsList
    board0targets = []
    board1targets = []
    board2targets = []
    board3targets = []
    board4targets = []
    
    for index, target in enumerate(ghTargetsList):
        if index < 20:
            parsedTargets[0] = 0x00
            parsedTargets[1] = target
            board0targets.append(parsedTargets)
            #print board0targets
        elif index > 19 and index < 39:
            parsedTargets[0] = 0x01
            parsedTargets[1] = target
            board1targets.append(parsedTargets)
        elif index > 38 and index < 59:
            parsedTargets[0] = 0x02
            parsedTargets[1] = target
            board2targets.append(parsedTargets)
        elif index > 58 and index < 78:
            parsedTargets[0] = 0x03
            parsedTargets[1] = target
            board3targets.append(parsedTargets)
        elif index > 77 and index < 98:
            parsedTargets[0] = 0x04
            parsedTargets[1] = target
            board4targets.append(parsedTargets)
        else:
            print "Invalid target index."

def movingState():
    moving_state0 = board0.getMovingState()
    moving_state1 = board1.getMovingState()
    moving_state2 = board2.getMovingState()
    moving_state3 = board3.getMovingState()
    moving_state4 = board4.getMovingState()

    if moving_state0 is False and \
       moving_state1 is False and \
       moving_state2 is False and \
       moving_state3 is False and \
       moving_state4 is False:
        return False
    else:
        return True


def setBoards():
    parseSpeeds(*speed_val)
    parseTargets(*angle_us1)

    speeds0 = board0.setSpeeds(*board0speeds)
    speeds1 = board1.setSpeeds(*board1speeds)
    speeds2 = board2.setSpeeds(*board2speeds)
    speeds3 = board3.setSpeeds(*board3speeds)
    speeds4 = board4.setSpeeds(*board4speeds)
          
    targets0 = board0.setTargets(0x14, 0x00,*board0targets)
    targets1 = board1.setTargets(0x13, 0x00,*board1targets)
    targets2 = board2.setTargets(0x14, 0x00,*board2targets) 
    targets3 = board3.setTargets(0x13, 0x00,*board3targets)
    targets4 = board4.setTargets(0x14, 0x00,*board4targets)

    # if movingState() == False:
    #     full_cmd = speeds0 + speeds1 + speeds2 + speeds3 + speeds4 + \
    #                targets0 + targets1 + targets2 + targets3 + targets4
    #     # print full_cmd
    #     myPort.write(bytes(bytearray(full_cmd)))
    #     print "Moving servos"
    # else:
    #     print "There are servos still moving."
    full_cmd = speeds0 + speeds1 + speeds2 + speeds3 + speeds4 + \
               targets0 + targets1 + targets2 + targets3 + targets4
    myPort.write(bytes(bytearray(full_cmd)))
    print full_cmd
    print "Moving servos"
        
def goHome():
    speed_val = []
    angle_us1 = []

    speed_val = [6]*98
    angle_us1= [1500]*98
    
    parseSpeeds(*speed_val)
    parseTargets(*angle_us1)

    speeds0 = board0.setSpeeds(*board0speeds)
    speeds1 = board1.setSpeeds(*board1speeds)
    speeds2 = board2.setSpeeds(*board2speeds)
    speeds3 = board3.setSpeeds(*board3speeds)
    speeds4 = board4.setSpeeds(*board4speeds)
          
    targets0 = board0.setTargets(0x14, 0x00,*board0targets)
    targets1 = board1.setTargets(0x13, 0x00,*board1targets)
    targets2 = board2.setTargets(0x14, 0x00,*board2targets) 
    targets3 = board3.setTargets(0x13, 0x00,*board3targets)
    targets4 = board4.setTargets(0x14, 0x00,*board4targets)

    full_cmd = speeds0 + speeds1 + speeds2 + speeds3 + speeds4 + \
               targets0 + targets1 + targets2 + targets3 + targets4
    # print full_cmd
    myPort.write(bytes(bytearray(full_cmd)))
    print "Homing"

def power_off(off_value):
    while movingState() == True:
        print "Waiting to go home."
    else:   
        print "Shutting servos off"
        trigger = off_value * 4
        lsb = trigger & 0x7f #7 bits for least significant byte
        msb = (trigger >> 7) & 0x7f #shift 7 and take next 7 bits for msb
        switch1 = [0xAA, 0x01, 0x04, 0x17, lsb, msb]
        switch2 = [0xAA, 0x03, 0x04, 0x17, lsb, msb]
        off_cmd = switch1 + switch2
        print off_cmd
        myPort.write(bytes(bytearray(off_cmd)))

def power_on(on_value):
    print "Power on"
    trigger = on_value * 4
    lsb = trigger & 0x7f #7 bits for least significant byte
    msb = (trigger >> 7) & 0x7f #shift 7 and take next 7 bits for msb
    switch1 = [0xAA, 0x01, 0x04, 0x17, lsb, msb]
    switch2 = [0xAA, 0x03, 0x04, 0x17, lsb, msb]
    on_cmd = switch1 + switch2
    print on_cmd
    myPort.write(bytes(bytearray(on_cmd)))


board0 = Controller(0x00)
board1 = Controller(0x01)
board2 = Controller(0x02)
board3 = Controller(0x03)
board4 = Controller(0x04)

if boards_off == 1:
    goHome()
    power_off(2000)
else:
    power_on(1000)
    #goHome()
    setBoards()
# ---------- end servo_control ----------
