# Grasshopper definition Kinect recorded data.gh (Grasshopper 0.9.76)
# plug-ins: Firefly.Kinect.V2

skeleton = KinectV2SkeletonTracker(StartSkeletonTracker=True)  # -> Joints, JointIDs, Bones; disabled
scale = Scale(Geometry=skeleton.Joints, Center=Point(0, 0, 0), Factor=Slider(100, range=0..100))  # -> Geometry, Transform
group = Group(Objects=scale.Geometry)
rec = DataRecorder(group, DataLimit=-10, RecordData=False)
panel = Panel(rec)
item = ListItem(List=[null x290], Index=Slider(99, range=0..289), Wrap=True)
geo = Geometry(item)
