# Grasshopper definition 2017-06-30 Kinect integration TESTING.gh (Grasshopper 0.9.76)
# plug-ins: Python Interpreter, Firefly.X, Firefly.Kinect.V2

# ----
# REAL TIME KINECT FEED
toggle = BooleanToggle(False)
skeleton = KinectV2SkeletonTracker(StartSkeletonTracker=toggle)  # -> Joints, JointIDs, Bones
scale = Scale(Geometry=skeleton.Joints, Center=Point(0, 0, 0), Factor=Slider(100, range=0..100))  # -> Geometry, Transform
group = Group(Objects=scale.Geometry)

# ----
# SAVED KINECT VALUES
number_slider = Slider(152, range=0..289)
pt = Point(Tree({0;0;0}: [Point(3.350782394, 148.7452149, -5.054104328), Point(3.531516343, 153.0034661, 29.63410318), Point(3.707515076, 155.8857679, 62.21989989), Point(2.334462851, 154.5491934, 77.16833949), Point(-15.45293033, 154.8241258, 48.60076904), Point(-19.92868334, 152.526772, 21.39601707)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], {0;0;1}: [Point(3.48145254, 148.7471581, -5.056969076), Point(3.66925858, 152.9838681, 29.62727845), Point(3.839514405, 155.8467746, 62.21054792), Point(2.614388987, 154.4806242, 77.16164589), Point(-15.27013928, 154.7181129, 48.64569902), Point(-19.84574795, 152.4627209, 21.3654846)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], {0;0;2}: [Point(3.604770824, 148.7112284, -5.060117692), Point(3.776441887, 152.945745, 29.61726189), Point(3.924155608, 155.8093905, 62.1964395), Point(2.785474248, 154.4152856, 77.15041637), Point(-15.1603058, 154.6653152, 48.66399765), Point(-19.74760145, 152.3891926, 21.36491686)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], {0;0;3}: [Point(3.812565655, 148.5575199, -5.041869357), Point(3.929695487, 152.8392196, 29.61531878), Point(4.026209563, 155.7451725, 62.18016148), Point(2.944506146, 154.323709, 77.12097168), Point(-15.02894163, 154.589653, 48.64757061), Point(-19.60199475, 152.2265673, 21.41273022)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], {0;0;4}: [Point(3.955206275, 148.4683037, -5.016152188), Point(4.045312107, 152.7622938, 29.63075638), Point(4.111967236, 155.6840301, 62.1852994), Point(3.040071018, 154.2543411, 77.10614204), Point(-15.01931548, 154.605484, 48.59758615), Point(-19.45874244, 152.1538377, 21.44294381)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], {0;0;5}: [Point(4.127969965, 148.3872294, -4.997505993), Point(4.189221561, 152.6789546, 29.64780331), Point(4.226023704, 155.6022763, 62.19794154), Point(3.13821733, 154.1562557, 77.0786047), Point(-14.83966112, 154.508853, 48.60133827), Point(-19.329983, 152.0763993, 21.39693946)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]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))
group_2 = Group(Objects=pt)  # -> flatten(Group)
item = ListItem(List=group_2, Index=number_slider, Wrap=True)
geo = Geometry(item)

panel = Panel(skeleton.JointIDs)

# ----
# KINECT CONTROLS
toggle_2 = BooleanToggle(False)
timer = Timer(TimerInterval=1000, Target=counter)  # disabled
counter = Counter(CountDirection=Toggle(True), Step=1, StartStop=Toggle(True), Reset=toggle_2, OptionalCounterDomain=Domain(0, 198))
panel_2 = Panel(counter)
scale_2 = Scale(Geometry=group, Center=Point(0, 0, 0), Factor=Slider(0.402, range=0..1))  # -> Geometry, Transform
Z = UnitZ(Factor=Slider(32, range=0..96))
move = Move(Geometry=scale_2.Geometry, Motion=Z)  # -> Geometry, Transform
X = UnitX(Factor=Slider(10, range=0..96))
move_2 = Move(Geometry=move.Geometry, Motion=expr("-x", X))  # -> Geometry, Transform
ungroup = Ungroup(Group=move_2.Geometry)
X_2 = UnitX(Factor=1)
item_2 = ListItem(List=ungroup, Index=Slider(0, range=0..24), Wrap=True)
rad = Radians(Degrees=Slider(0, range=-90..0))
rad_2 = Radians(Degrees=Slider(180, range=0..180))
pt_2 = ConstructPoint(XCoordinate=0, YCoordinate=0, ZCoordinate=0)
rot3d = Rotate3D(Geometry=ungroup, Angle=rad, Center=item_2, Axis=X_2)  # -> Geometry, Transform
rot3d_2 = Rotate3D(Geometry=rot3d.Geometry, Angle=rad_2, Center=pt_2, Axis=Vector(0, 0, 1))  # -> Geometry, Transform

rec = DataRecorder(group, DataLimit=-10, RecordData=False)
grp = Group(rec)
ungroup_2 = Ungroup(Group=grp)
pt_3 = Point(Tree({0;0;0}: [Point(0, 0, 0), Point(0, 0, 5.615384615), Point(0, 0, 11.23076923), Point(0, 0, 16.84615385), Point(0, 0, 22.46153846), Point(0, 0, 28.07692308), Point(0, 0, 33.69230769), Point(0, 0, 39.30769231), Point(0, 0, 44.92307692), Point(0, 0, 50.53846154), Point(0, 0, 56.15384615), Point(0, 0, 61.76923077), Point(0, 0, 67.38461538)], {0;0;1}: [Point(3.6, 0, 0), Point(3.6, 0, 5.615384615), Point(3.6, 0, 11.23076923), Point(3.6, 0, 16.84615385), Point(3.6, 0, 22.46153846), Point(3.6, 0, 28.07692308), Point(3.6, 0, 33.69230769), Point(3.6, 0, 39.30769231), Point(3.6, 0, 44.92307692), Point(3.6, 0, 50.53846154), Point(3.6, 0, 56.15384615), Point(3.6, 0, 61.76923077), Point(3.6, 0, 67.38461538)], {0;0;2}: [Point(7.2, 0, 0), Point(7.2, 0, 5.615384615), Point(7.2, 0, 11.23076923), Point(7.2, 0, 16.84615385), Point(7.2, 0, 22.46153846), Point(7.2, 0, 28.07692308), Point(7.2, 0, 33.69230769), Point(7.2, 0, 39.30769231), Point(7.2, 0, 44.92307692), Point(7.2, 0, 50.53846154), Point(7.2, 0, 56.15384615), Point(7.2, 0, 61.76923077), Point(7.2, 0, 67.38461538)], {0;0;3}: [Point(10.8, 0, 0), Point(10.8, 0, 5.615384615), Point(10.8, 0, 11.23076923), Point(10.8, 0, 16.84615385), Point(10.8, 0, 22.46153846), Point(10.8, 0, 28.07692308), Point(10.8, 0, 33.69230769), Point(10.8, 0, 39.30769231), Point(10.8, 0, 44.92307692), Point(10.8, 0, 50.53846154), Point(10.8, 0, 56.15384615), Point(10.8, 0, 61.76923077), Point(10.8, 0, 67.38461538)], {0;0;4}: [Point(14.4, 0, 0), Point(14.4, 0, 5.615384615), Point(14.4, 0, 11.23076923), Point(14.4, 0, 16.84615385), Point(14.4, 0, 22.46153846), Point(14.4, 0, 28.07692308), Point(14.4, 0, 33.69230769), Point(14.4, 0, 39.30769231), Point(14.4, 0, 44.92307692), Point(14.4, 0, 50.53846154), Point(14.4, 0, 56.15384615), Point(14.4, 0, 61.76923077), Point(14.4, 0, 67.38461538)], {0;0;5}: [Point(18, 0, 0), Point(18, 0, 5.615384615), Point(18, 0, 11.23076923), Point(18, 0, 16.84615385), Point(18, 0, 22.46153846), Point(18, 0, 28.07692308), Point(18, 0, 33.69230769), Point(18, 0, 39.30769231), Point(18, 0, 44.92307692), Point(18, 0, 50.53846154), Point(18, 0, 56.15384615), Point(18, 0, 61.76923077), Point(18, 0, 67.38461538)]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))

# ----
# GENERATING PANELS
total_length_in = Slider(54, range=0..96)
total_height_in = Slider(73, range=0..96)
division = Division(A=total_height_in, B=Slider(13, range=0..20))
division_2 = Division(A=total_length_in, B=Slider(15, range=0..24))
Z_2 = UnitZ(Factor=1)
X_3 = UnitX(Factor=1)
culln = CullNth(List=flatten(pt_3), CullFrequency=2)
xz = XZPlane(Origin=culln)
rectangle = Rectangle(Plane=xz, XSize=Slider(7, range=0..11), YSize=Slider(11, range=0..11), Radius=0)  # -> Rectangle, Length
edges = BrepEdges(Brep=rectangle.Rectangle)  # -> Naked, Interior, NonManifold
divide = DivideCurve(Curve=edges.Naked, Count=Slider(2, range=0..2), Kinks=False)  # -> Points, Tangents, Parameters
item_3 = ListItem(List=simplify(divide.Points), Index=1, Wrap=True)
pshift = ShiftPaths(Data=item_3, Offset=-1)
intcrv = Interpolate(Vertices=pshift, Degree=1, Periodic=True, KnotStyle=1)  # -> Curve, Length, Domain
boundary = BoundarySurfaces(Edges=intcrv.Curve)  # -> flatten(Surfaces)
X_4 = UnitX(Factor=1)
move_3 = Move(Geometry=boundary, Motion=expr("x*-30", X_4))  # -> Geometry, Transform

points = PointList(Points=rot3d_2.Geometry)

# ----
# FULL BODY CONTROL
item_4 = ListItem(List=rot3d_2.Geometry, Index=7, Wrap=True)
item_5 = ListItem(List=rot3d_2.Geometry, Index=3, Wrap=True)
item_6 = ListItem(List=rot3d_2.Geometry, Index=11, Wrap=True)
item_7 = ListItem(List=rot3d_2.Geometry, Index=19, Wrap=True)
item_8 = ListItem(List=rot3d_2.Geometry, Index=15, Wrap=True)
intcrv_2 = Interpolate(Vertices=[item_4, item_5, item_6, item_7, item_8], Degree=3, Periodic=True, KnotStyle=1)  # -> Curve, Length, Domain
xz_2 = XZPlane(Origin=Point(0, 0, 0))
project = Project(Geometry=intcrv_2.Curve, Plane=xz_2)  # -> Geometry, Transform
topoly = CurveToPolyline(Curve=project.Geometry, ToleranceDistance=0, ToleranceAngle=0)  # -> Polyline, Segments
pcen = PolygonCenter(Polyline=topoly.Polyline)  # -> CenterV, CenterE, CenterA
geo_2 = Geometry(pcen.CenterE)

# ----
# CORE PT
number_slider_2 = Slider(2, range=0..24)
item_9 = ListItem(List=rot3d_2.Geometry, Index=number_slider_2, Wrap=True)
xz_3 = XZPlane(Origin=Point(0, 0, 0))
project_2 = Project(Geometry=item_9, Plane=xz_3)  # -> Geometry, Transform

# ----
# RIGHT HAND CONTROL
number_slider_3 = Slider(23, range=0..24)
item_10 = ListItem(List=rot3d_2.Geometry, Index=number_slider_3, Wrap=True)  # -> Item, Item1
project_3 = Project(Geometry=item_10.Item, Plane=xz_3)  # -> Geometry, Transform

# ----
# LEFT HAND CONTROL
number_slider_4 = Slider(21, range=0..24)
item_11 = ListItem(List=rot3d_2.Geometry, Index=number_slider_4, Wrap=True)  # -> Item, Item1
item_12 = ListItem(List=rot3d_2.Geometry, Index=7, Wrap=True)
project_4 = Project(Geometry=item_11.Item, Plane=xz_3)  # -> Geometry, Transform
project_5 = Project(Geometry=item_12, Plane=xz_3)  # -> Geometry, Transform

item_13 = ListItem(List=rot3d_2.Geometry, Index=11, Wrap=True)
dist = Distance(PointA=item_10.Item, PointB=item_10.Item1)
dist_2 = Distance(PointA=item_11.Item, PointB=item_11.Item1)
panel_3 = Panel([dist_2, dist])
project_6 = Project(Geometry=item_13, Plane=xz_3)  # -> Geometry, Transform
num = Number(expr("round(x,1)", graft([dist_2, dist])))
pt_4 = Point(graft([project_4.Geometry, project_3.Geometry]))
rec_2 = DataRecorder(num, DataLimit=5, RecordData=True)  # disabled
rec_3 = DataRecorder(pt_4, DataLimit=3, RecordData=True)  # disabled
avr = Average(Input=num)
number_slider_5 = Slider(2, range=0..36)
number_slider_6 = Slider(6, range=0..36)
avr_2 = Average(Input=pt_4)
min = Minimum(A=avr, B=number_slider_6)
xz_4 = XZPlane(Origin=avr_2)
max = Maximum(A=min, B=number_slider_5)
dom = ConstructDomain(DomainStart=Slider(2, range=0..36), DomainEnd=Slider(18, range=0..36))
dom_2 = ConstructDomain(DomainStart=number_slider_5, DomainEnd=number_slider_6)
remap = RemapNumbers(Value=max, Source=dom_2, Target=dom)  # -> Mapped, Clipped
cir = Circle(Plane=flatten(xz_4), Radius=flatten(remap.Mapped))

# ----
# index labels
number_slider_7 = Slider(2.013, range=0..5)
area = Area(Geometry=move_3.Geometry)  # -> Area, Centroid
points_2 = PointList(Points=area.Centroid, Size=number_slider_7)

genes = GenePool(Decimals=3, Maximum=100, Minimum=-100, Value=[-44.121, -5.585, -15.8248, 77.332, -80.178, -12.5116, 18.531])
genes_2 = GenePool(Decimals=3, Maximum=200, Minimum=-200, Value=[20.875, -16.926, -48.102, 96.204, -74.125, -126.168])
genes_3 = GenePool(Decimals=3, Maximum=200, Minimum=-200, Value=[29.966, -86.466, 0, 4.14, 0, 0, -67.992])
genes_4 = GenePool(Decimals=3, Maximum=200, Minimum=-200, Value=[-22.44, -10.82, 47.374, 82.651, 18.143, -96.355])
genes_5 = GenePool(Decimals=3, Maximum=200, Minimum=-200, Value=[-41.771, -73.991, 0, -49.743, -39.379, -96.028, -64.037])
number_slider_8 = Slider(98, range=0..98)
round = Round(Acceleration=Slider(8, range=1..255))  # -> Acceleration, Floor, Ceiling
round_2 = Round(Angle_us=Slider(1500, range=700..2300))  # -> Angle_us, Floor, Ceiling
round_3 = Round(Number=Slider(4, range=1..250))  # -> Nearest, Floor, Ceiling
genes_6 = GenePool(Decimals=3, Maximum=500, Minimum=-500, Value=[43.568, -14.569, 11.457, -69.527, -23.916, 72.918])
dup = DuplicateData(Data=round_2.Angle_us, Number=number_slider_8, Order=True)
genes_7 = GenePool(Decimals=3, Maximum=200, Minimum=-200, Value=[-45.056, 41.309, 0, 60.13, 59.826, -65.524, -103.984])
genes_8 = GenePool(Decimals=3, Maximum=200, Minimum=-200, Value=[17.285, 76.055, -27.12, 72.598, -42.637, 17.285])
genes_9 = GenePool(Decimals=3, Maximum=200, Minimum=-200, Value=[9.727, -78.359, -43.789, -59.276, -34.57, 0, 44.941])
genes_10 = GenePool(Decimals=3, Maximum=200, Minimum=-200, Value=[34.57, 40.332, 53.008, 16.133, 17.285, 43.789])
genes_11 = GenePool(Decimals=3, Maximum=200, Minimum=-200, Value=[59.922, 25.352, 94.492, -23.009, -46.094, 41.484, 10.372])
genes_12 = GenePool(Decimals=3, Maximum=200, Minimum=-200, Value=[-44.667, -47.246, 111.776, -66.834, 38.027, -49.551])
genes_13 = GenePool(Decimals=3, Maximum=200, Minimum=-200, Value=[-83.946, -21.895, -51.855, -103.711, 29.961, -62.227, -62.227])
genes_14 = GenePool(Decimals=3, Maximum=200, Minimum=-200, Value=[-72.726, 66.836, 35.723, -101.406, 43.789, -54.16])
genes_15 = GenePool(Decimals=3, Maximum=200, Minimum=-200, Value=[63.377, -46.094, 80.664, 32.912, -6.914, 26.502, 65.685])
num_2 = Number([genes, genes_2, genes_3, genes_4, genes_5, genes_6, genes_7, genes_8, genes_9, genes_10, genes_11, genes_12, genes_13, genes_14, genes_15])

# ----
# ROTATION LOGIC
area_2 = Area(Geometry=move_3.Geometry)  # -> Area, graft(Centroid)
srf = Surface(cir)
dist_3 = Distance(PointA=[project_3.Geometry, project_4.Geometry], PointB=graft(area_2.Centroid))

srf_cp = SurfaceClosestPoint(Point=area_2.Centroid, Surface=srf)  # -> Point, UVPoint, Distance

graph = GraphMapper(srf_cp.Distance, x0=0, x1=1, y0=0, y1=1, container_name="Power", Gx=0.2457505316, Gy=0.7582647204, power=0.1971748296)

sort = SortList(Keys=graph)  # -> Keys, ValuesA
item_14 = ListItem(List=sort.Keys, Index=0, Wrap=True)

# ----
# GENERATING RHINO VISUAL
_90 = Number(90)
_0 = Number(0)
bnd = Bounds(Numbers=flatten(item_14))
dom_3 = ConstructDomain(DomainStart=_90, DomainEnd=_0)
remap_2 = RemapNumbers(Value=item_14, Source=bnd, Target=dom_3)  # -> Mapped, Clipped
subtraction = Subtraction(A=90, B=remap_2.Mapped)
rad_3 = Radians(Degrees=subtraction)
Z_3 = UnitZ(Factor=1)
rot3d_3 = Rotate3D(Geometry=graft(move_3.Geometry), Angle=rad_3, Center=area_2.Centroid, Axis=Z_3)  # -> Geometry, Transform
preview = CustomPreview(Geometry=rot3d_3.Geometry, Shader=ColourSwatch(SwatchColor=RGBA(242, 244, 252, 214)))

# ----
# GENERATING ANGLE VALUES
# FOR SINGLE SIDE ROTATION
# 
# FULL RANGE IS -800 TO +800 WITH
# 1500 AS THE FLAT (0) STATE
_800 = Number(800)
_0_2 = Number(0)
bnd_2 = Bounds(Numbers=flatten(item_14))
dom_4 = ConstructDomain(DomainStart=_800, DomainEnd=_0_2)
remap_3 = RemapNumbers(Value=item_14, Source=bnd_2, Target=dom_4)  # -> Mapped, Clipped
subtraction_2 = Subtraction(A=_800, B=remap_3.Mapped)
_1500 = Number(1500)
addition = Addition(A=_1500, B=subtraction_2)

subtraction_3 = Subtraction(A=_1500, B=subtraction_2)

round_4 = Round(Number=subtraction_3)  # -> flatten(Nearest), Floor, Ceiling

bnd_3 = Bounds(Numbers=flatten(subtraction_3))
panel_4 = Panel(subtraction_2)
addition_2 = Addition(A=round_4.Nearest, B=num_2)
int = Integer(addition_2)

# ----
# SERIAL COMMUNICATION
number_slider_9 = Slider(112500, range=0..112500)
boards_off = Slider(1, range=0..1)
dup_2 = DuplicateData(Data=round_3.Nearest, Number=number_slider_8, Order=True)
open_port = PythonScript(baudrate=number_slider_9, port="COM4", open=Toggle(False))  # -> out, a
# ---------- open_port: Python ----------
import serial
import scriptcontext

SCS = scriptcontext.sticky
K = 'serialport'

if K in SCS:
    myPort=SCS[K]
else:
    myPort=serial.Serial()
    
if open == True:
    try:
        myPort.baudrate = baudrate
        myPort.port = port
        myPort.open()
        SCS[K] = myPort
    except:
        print "Something went wrong. Cannot open port."
    if myPort.isOpen() == True:
        print myPort.name + " is open"
        
if open != True:
    try:
        myPort.close()
    except:
        print "Something went wrong. Cannot close port."
    if myPort.isOpen != True:
        print "Port is closed"
# ---------- end open_port ----------
servo_control = PythonScript(speed_val=dup_2, angle_us1=int, boards_off=boards_off, test_mode=Toggle(False))  # -> out, a; inputs speed_val: list, angle_us1: list
# ---------- servo_control: Python ----------
import serial
import scriptcontext
import base64

myPort = scriptcontext.sticky['serialport']
myPort.flushInput()
myPort.flushOutput()

ghSpeedsList = []
board0speeds = []
board1speeds = []
board2speeds = []
board3speeds = []
board4speeds = []

ghTargetsList = []
board0targets = []
board1targets = []
board2targets = []
board3targets = []
board4targets = []

print speed_val
print angle_us1

class Controller:
    
    def __init__(self, device_number = 0x00):
        # Define the object as the already open port
        self.usb = myPort
        # Command lead-in and device number are sent for each Pololu serial commands.
        self.PololuCmd = [0xaa, device_number]
     
    def setTargets(self, num_targets, start_chan = 0x00, *targets):

        valueList = list(targets)
        cmdSplitList = []
        # print valueList

        qValueList = [us*4 for us in valueList]
        #print qValueList

        for value in qValueList:
            lsb = value & 0x7f #7 bits for least significant byte
            msb = (value >> 7) & 0x7f #shift 7 and take next 7 bits for msb
            cmdSplitList.append(lsb)
            cmdSplitList.append(msb)
        #print cmdSplitList

        # Send Pololu intro, device number, multiple targets command, number of targets, start channel, and targets lsb/msb
        multi_target_cmd = [0x1F, num_targets, start_chan]
        cmd_intro = self.PololuCmd + multi_target_cmd
        cmd = cmd_intro + cmdSplitList
        #print cmd
        return cmd
        # self.usb.write(bytes(bytearray(cmd)))
        # myPort.write(bytes(bytearray(cmd)))
        # # Record Target value
        # self.Targets[chan] = target
        
    # Set speeds for all used channels on each board
    # Speed is measured as 0.25microseconds/10milliseconds
    # For the standard 1ms pulse width change to move a servo between extremes, a speed
    # of 1 will take 1 minute, and a speed of 60 would take 1 second.
    # Speed of 0 is unrestricted.
    def setSpeeds(self, *speeds):
        
        valueList = list(speeds)
        cmdSplitList = []
        speed_cmd = []
        #print valueList

        qValueList = [us*4 for us in valueList]

        # Send Pololu intro, device number, command, channel, and target lsb/msb
        for chan, value in enumerate(qValueList):
            lsb = value & 0x7f #7 bits for least significant byte
            msb = (value >> 7) & 0x7f #shift 7 and take next 7 bits for msb
            set_speed_cmd = [0x07, chan, lsb, msb]
            cmd = self.PololuCmd + set_speed_cmd
            speed_cmd = speed_cmd + cmd
        # print speed_cmd
        return speed_cmd
            # print cmd
        
    # Set acceleration of channel
    # This provide soft starts and finishes when servo moves to target position.
    # Valid values are from 0 to 255. 0=unrestricted, 1 is slowest start.
    # A value of 1 will take the servo about 3s to move between 1ms to 2ms range.
    def setAccel(self, chan, accel):
        pass
        # lsb = accel & 0x7f #7 bits for least significant byte
        # msb = (accel >> 7) & 0x7f #shift 7 and take next 7 bits for msb
        # # Send Pololu intro, device number, command, channel, accel lsb, accel msb
        # cmd = self.PololuCmd + chr(0x09) + chr(chan) + chr(lsb) + chr(msb)
        # self.usb.write(bytes(bytearray(cmd)))
    

    def getMovingState(self):
        intro_cmd = self.PololuCmd
        moving = [0x13]
        cmd = intro_cmd + moving
        # print cmd
        self.usb.write(bytes(bytearray(cmd)))
        response = self.usb.read()
        # response = myPort.read()
        print (base64.b16encode(response) + "\n")
        if response == chr(0):
            return False
        else:
            return True

# the parsing functions create the arrays of speeds and targets used for each board
# both functions take a list of 98 values which is the number of servos used in the project
# in the full version of the program the lists are generated dynamically - target values for the 98 servos will generally be all different, speeds may or may not be different
def parseSpeeds(*ghSpeeds):
    global ghSpeedsList, board0speeds, board1speeds, board2speeds, board3speeds, board4speeds

    ghSpeedsList = list(ghSpeeds)
    #print ghSpeedsList
    board0speeds = []
    board1speeds = []
    board2speeds = []
    board3speeds = []
    board4speeds = []
    
    for index, speed in enumerate(ghSpeedsList):
        if index < 20:
            board0speeds.append(speed)
        elif index > 19 and index < 39:
            board1speeds.append(speed)
        elif index > 38 and index < 59:
            board2speeds.append(speed)
        elif index > 58 and index < 78:
            board3speeds.append(speed)
        elif index > 77 and index < 98:
            board4speeds.append(speed)
        else:
            print "Invalid speed index."

def parseTargets(*ghTargets):
    global ghTargetsList, board0targets, board1targets, board2targets, board3targets, board4targets

    ghTargetsList = list(ghTargets)
    # print ghTargetsList
    board0targets = []
    board1targets = []
    board2targets = []
    board3targets = []
    board4targets = []
    # print board0targets
    # print board1targets
    # print board2targets
    # print board3targets
    # print board4targets
    
    for index, target in enumerate(ghTargetsList):
        if index < 20:
            # print index, target
            board0targets.append(target)
            # print board0targets
        elif index > 19 and index < 39:
            # print index, target
            board1targets.append(target)
            # print board1targets
        elif index > 38 and index < 59:
            # print index, target
            board2targets.append(target)
            # print board2targets
        elif index > 58 and index < 78:
            # print index, target
            board3targets.append(target)
            # print board3targets
        elif index > 77 and index < 98:
            # print index, target
            board4targets.append(target)
            # print board4targets
        else:
            print "Invalid target index."
    # print board0targets
    # print board1targets
    # print board2targets
    # print board3targets
    # print board4targets

def movingState():
    moving_state0 = board0.getMovingState()
    moving_state1 = board1.getMovingState()
    moving_state2 = board2.getMovingState()
    moving_state3 = board3.getMovingState()
    moving_state4 = board4.getMovingState()

    if moving_state0 is False and \
       moving_state1 is False and \
       moving_state2 is False and \
       moving_state3 is False and \
       moving_state4 is False:
        return False
    else:
        return True


def setBoards():
    parseSpeeds(*speed_val)
    parseTargets(*angle_us1)
    
    speeds0 = board0.setSpeeds(*board0speeds)
    speeds1 = board1.setSpeeds(*board1speeds)
    speeds2 = board2.setSpeeds(*board2speeds)
    speeds3 = board3.setSpeeds(*board3speeds)
    speeds4 = board4.setSpeeds(*board4speeds)
          
    targets0 = board0.setTargets(0x14, 0x00,*board0targets)
    targets1 = board1.setTargets(0x13, 0x00,*board1targets)
    targets2 = board2.setTargets(0x14, 0x00,*board2targets) 
    targets3 = board3.setTargets(0x13, 0x00,*board3targets)
    targets4 = board4.setTargets(0x14, 0x00,*board4targets)

    # if movingState() == False:
    #     full_cmd = speeds0 + speeds1 + speeds2 + speeds3 + speeds4 + \
    #                targets0 + targets1 + targets2 + targets3 + targets4
    #     # print full_cmd
    #     myPort.write(bytes(bytearray(full_cmd)))
    #     print "Moving servos"
    # else:
    #     print "There are servos still moving."
    full_cmd = speeds0 + speeds1 + speeds2 + speeds3 + speeds4 + \
               targets0 + targets1 + targets2 + targets3 + targets4
    myPort.write(bytes(bytearray(full_cmd)))
    # print full_cmd
    print "Moving servos"
        
def goHome():
    speed_val = []
    angle_us1 = []

    speed_val = [6]*98
    angle_us1= [1500]*98
    
    parseSpeeds(*speed_val)
    parseTargets(*angle_us1)

    speeds0 = board0.setSpeeds(*board0speeds)
    speeds1 = board1.setSpeeds(*board1speeds)
    speeds2 = board2.setSpeeds(*board2speeds)
    speeds3 = board3.setSpeeds(*board3speeds)
    speeds4 = board4.setSpeeds(*board4speeds)
          
    targets0 = board0.setTargets(0x14, 0x00,*board0targets)
    targets1 = board1.setTargets(0x13, 0x00,*board1targets)
    targets2 = board2.setTargets(0x14, 0x00,*board2targets) 
    targets3 = board3.setTargets(0x13, 0x00,*board3targets)
    targets4 = board4.setTargets(0x14, 0x00,*board4targets)

    full_cmd = speeds0 + speeds1 + speeds2 + speeds3 + speeds4 + \
               targets0 + targets1 + targets2 + targets3 + targets4
    # print full_cmd
    myPort.write(bytes(bytearray(full_cmd)))
    print "Homing"

def power_off(off_value):
    while movingState() == True:
        print "Waiting to go home."
    else:   
        print "Shutting servos off"
        trigger = off_value * 4
        lsb = trigger & 0x7f #7 bits for least significant byte
        msb = (trigger >> 7) & 0x7f #shift 7 and take next 7 bits for msb
        switch1 = [0xAA, 0x01, 0x04, 0x17, lsb, msb]
        switch2 = [0xAA, 0x03, 0x04, 0x17, lsb, msb]
        off_cmd = switch1 + switch2
        print off_cmd
        myPort.write(bytes(bytearray(off_cmd)))

def power_on(on_value):
    print "Power on"
    trigger = on_value * 4
    lsb = trigger & 0x7f #7 bits for least significant byte
    msb = (trigger >> 7) & 0x7f #shift 7 and take next 7 bits for msb
    switch1 = [0xAA, 0x01, 0x04, 0x17, lsb, msb]
    switch2 = [0xAA, 0x03, 0x04, 0x17, lsb, msb]
    on_cmd = switch1 + switch2
    print on_cmd
    myPort.write(bytes(bytearray(on_cmd)))

def testMode():
    print "Testing individual channels"
    

    speed_val = []
    angle_us1 = []

    speed_val = [2]*98
    angle_us1= [1300]*98
    
    parseSpeeds(*speed_val)
    parseTargets(*angle_us1)

    speeds0 = board0.setSpeeds(*board0speeds)
    speeds1 = board1.setSpeeds(*board1speeds)
    speeds2 = board2.setSpeeds(*board2speeds)
    speeds3 = board3.setSpeeds(*board3speeds)
    speeds4 = board4.setSpeeds(*board4speeds)
          
    targets0 = board0.setTargets(0x14, 0x00,*board0targets)
    targets1 = board1.setTargets(0x13, 0x00,*board1targets)
    targets2 = board2.setTargets(0x14, 0x00,*board2targets) 
    targets3 = board3.setTargets(0x13, 0x00,*board3targets)
    targets4 = board4.setTargets(0x14, 0x00,*board4targets)

    full_cmd = speeds0 + speeds1 + speeds2 + speeds3 + speeds4 + \
               targets0 + targets1 + targets2 + targets3 + targets4
    # print full_cmd
    myPort.write(bytes(bytearray(full_cmd)))
    
    while movingState() == True:
        print "Testing left."
    else: 
        print "Testing right."
        speed_val = []
        angle_us1 = []

        speed_val = [2]*98
        angle_us1= [1700]*98
        
        parseSpeeds(*speed_val)
        parseTargets(*angle_us1)

        speeds0 = board0.setSpeeds(*board0speeds)
        speeds1 = board1.setSpeeds(*board1speeds)
        speeds2 = board2.setSpeeds(*board2speeds)
        speeds3 = board3.setSpeeds(*board3speeds)
        speeds4 = board4.setSpeeds(*board4speeds)
              
        targets0 = board0.setTargets(0x14, 0x00,*board0targets)
        targets1 = board1.setTargets(0x13, 0x00,*board1targets)
        targets2 = board2.setTargets(0x14, 0x00,*board2targets) 
        targets3 = board3.setTargets(0x13, 0x00,*board3targets)
        targets4 = board4.setTargets(0x14, 0x00,*board4targets)

        full_cmd = speeds0 + speeds1 + speeds2 + speeds3 + speeds4 + \
                   targets0 + targets1 + targets2 + targets3 + targets4
        # print full_cmd
        myPort.write(bytes(bytearray(full_cmd)))
            

board0 = Controller(0x00)
board1 = Controller(0x01)
board2 = Controller(0x02)
board3 = Controller(0x03)
board4 = Controller(0x04)

if boards_off == 1:
    goHome()
    power_off(2000)
elif test_mode == True:
    goHome()
    testMode()
else:
    power_on(1000)
    #goHome()
    setBoards()
# ---------- end servo_control ----------
panel_5 = Panel(open_port.out)
