# Grasshopper definition 2017_2_14_data transfer testing.gh (Grasshopper 0.9.76)
# plug-ins: Firefly.X, gHowl, Firefly.Core

panel = Panel("10.0.1.5")
netsource = NetworkSource()  # -> NetworkAdapterIsUp, AdapterProperties, LocalIpAddress; disabled
_6001 = Number(6001)
udp = UDPReceiver(Address=netsource.LocalIpAddress, Port=_6001, Pattern=0)  # -> Info, Data; disabled
timer = Timer(TimerInterval=100, Target=udp_listener)  # disabled
addition = Addition(B=90)
ports_available = COMPortsAvailable()
panel_2 = Panel(udp.Data)
udp_listener = UDPListener(Port=_6001)  # disabled
rotationangleforarduino = Number(flatten(addition))
panel_3 = Panel(udp_listener)
_4 = Number(4)
_3 = Number(3)
open_port = OpenClosePort(OpenClosePort=Toggle(True), PortNumber=_3, BaudRate=115200)
timer_2 = Timer(TimerInterval=1000, Target=read)
_10000 = Number(10000)
split = TextSplit(Text=panel_3, Separators=",")
read = SerialReadGeneric(StartReadingValues=Toggle(True), PortNumber=_3)  # -> SerialOutput, StatusMessage
addition_2 = Addition(A=Slider(1, range=0..1), B=_10000)
panel_4 = Panel(split)
repeat = RepeatData(Data=addition_2, Length=Slider(4, range=0..11))
round = Round(Number=repeat)  # -> Nearest, Floor, Ceiling
int = Integer(graft(panel_4))
multiplication = Multiplication(A=read.SerialOutput, B=_4)
timer_3 = Timer(TimerInterval=1000, Target=counter)  # disabled
join = TextJoin(Text=round.Nearest, Join=",")  # -> simplify(flatten(Result))
panel_5 = Panel(read.SerialOutput)
counter = Counter(CountDirection=True, Step=3, StartStop=Toggle(True), Reset=Toggle(False), OptionalCounterDomain=Domain(0, 10000))
panel_6 = Panel("[5, 3, 6]")
panel_7 = Panel(counter)
concat = Concatenate(FragmentA=join)
panel_8 = Panel("0xF50x0D0x00")
write = SerialWriteGeneric(StartWritingValues=Toggle(True), WriteData=concat, PortNumber=_3)  # -> ArduinoOutput, StatusMessage
panel_9 = Panel(write.ArduinoOutput)
