# Grasshopper definition 2017_3_7_data transfer testing.gh (Grasshopper 0.9.76)
# plug-ins: Firefly.Core

ports_available = COMPortsAvailable()
_4 = Number(4)
_3 = Number(3)
open_port = OpenClosePort(OpenClosePort=Toggle(False), PortNumber=_3, BaudRate=115200)

# ----
# FOR DEBUGGING: shows the values being sent to the servo
toggle = BooleanToggle(False)
timer = Timer(TimerInterval=1000, Target=read)  # disabled
read = SerialReadGeneric(StartReadingValues=toggle, PortNumber=_3)  # -> SerialOutput, StatusMessage
panel = Panel(read.SerialOutput)

round = Round(Number=Slider(180, range=0..180))  # -> Nearest, Floor, Ceiling
concat = Concatenate(FragmentA="s", FragmentB=round.Nearest)
write = SerialWriteGeneric(StartWritingValues=Toggle(False), WriteData=concat, PortNumber=_3)  # -> ArduinoOutput, StatusMessage
panel_2 = Panel(write.ArduinoOutput)
