# Grasshopper definition 2016_8_16_Lorgan Arduino Testing 2.gh (Grasshopper 0.9.76)
# plug-ins: PTComponentLibrary, Firefly.Kinect.V1, Firefly.Core

total_length_in = Slider(60, range=0..96)
total_height_in = Slider(84, range=0..96)
number_slider = Slider(14, range=0..20)
number_slider_2 = Slider(16, range=0..24)
division = Division(A=total_height_in, B=number_slider)
division_2 = Division(A=total_length_in, B=number_slider_2)
Z = UnitZ(Factor=1)
ptplanar = PlanarGrid(
    BasePoint=Point(0, 0, 0),
    IDir=Vector(1, 0, 0),
    JDir=Z,
    IDistance=division,
    JDistance=division_2,
    INumber=expr("x+1", number_slider),
    JNumber=expr("x+1", number_slider_2))
pttodiamond = ConvertToDiamond(Grid=ptplanar)
ptfaces = GenerateFaces(Grid=pttodiamond, PanelShape=0)
ptfaces_2 = GenerateFaces(Grid=pttodiamond, PanelShape=0)  # -> flatten(Faces)
edges = BrepEdges(Brep=ptfaces)  # -> simplify(Naked), Interior, NonManifold
panel = Panel(ptfaces_2)
item = ListItem(List=edges.Naked, Index=0, Wrap=True)  # -> Item, Item1, Item2, Item3
ccx = CurveCurve(CurveA=item.Item, CurveB=item.Item1)  # -> flatten(Points), ParamsA, ParamsB
points = PointList(Points=ccx.Points, Size=Slider(2, range=0..30))
number_slider_3 = Slider(1.586, range=0..18)
item_2 = ListItem(List=ccx.Points, Index=60, Wrap=True)
item_3 = ListItem(List=ccx.Points, Index=71, Wrap=True)
item_4 = ListItem(List=ccx.Points, Index=60, Wrap=True)
item_5 = ListItem(List=ccx.Points, Index=47, Wrap=True)
xz = XZPlane(Origin=Point(0, 0, 0))
aligndim = AlignedDimension(Plane=xz, PointA=item_2, PointB=item_3, Offset=Slider(0, range=-18..0), Text="{0:0.00}", Size=number_slider_3)
preview = CustomPreview(Geometry=ptfaces, Shader=ColourSwatch(SwatchColor=RGBA(242, 244, 252, 214)))
aligndim_2 = AlignedDimension(Plane=xz, PointA=item_4, PointB=item_5, Offset=Slider(0, range=0..30), Text="{0:0.00}", Size=number_slider_3)
depth_stream = KinectV1DepthStream(ShowFalsecolor=True)
skeleton = KinectV1SkeletalTracker(
    StartSkeletonTracker=True,
    SkeletonScaleFactor=Slider(40, range=0..50),
    TranslateInZAxis=Slider(39, range=0..50),
    TimerIntervalInMillisecondsForUpdatingEvents=5)  # -> Points, JointID, Bones
panel_2 = Panel(skeleton.JointID)
group = Group(Objects=skeleton.Points)
rec = DataRecorder(group, DataLimit=-10, RecordData=False)
Z_2 = UnitZ(Factor=Slider(25, range=0..96))
item_6 = ListItem(List=rec, Index=Slider(83, range=0..100), Wrap=True)
move = Move(Geometry=item_6, Motion=Z_2)  # -> Geometry, Transform
ungroup = Ungroup(Group=move.Geometry)
X = UnitX(Factor=1)
item_7 = ListItem(List=ungroup, Index=0, Wrap=True)
rad = Radians(Degrees=Slider(0, range=-90..0))
rot3d = Rotate3D(Geometry=ungroup, Angle=rad, Center=item_7, Axis=X)  # -> Geometry, Transform
item_8 = ListItem(List=rot3d.Geometry, Index=7, Wrap=True)
item_9 = ListItem(List=rot3d.Geometry, Index=3, Wrap=True)
item_10 = ListItem(List=rot3d.Geometry, Index=11, Wrap=True)
item_11 = ListItem(List=rot3d.Geometry, Index=19, Wrap=True)
item_12 = ListItem(List=rot3d.Geometry, Index=15, Wrap=True)
intcrv = Interpolate(Vertices=[item_8, item_9, item_10, item_11, item_12], Degree=3, Periodic=True, KnotStyle=1)  # -> Curve, Length, Domain
xz_2 = XZPlane(Origin=Point(0, 0, 0))
project = Project(Geometry=intcrv.Curve, Plane=xz_2)  # -> Geometry, Transform
center_points = Geometry(Tree({0;1}: [Point(25.71428571, 0, 6)], {0;2}: [Point(17.14285714, 0, 6), Point(21.42857143, 0, 12), Point(25.71428571, 0, 18)], {0;3}: [Point(8.571428571, 0, 6), Point(12.85714286, 0, 12), Point(17.14285714, 0, 18), Point(21.42857143, 0, 24), Point(25.71428571, 0, 30)], {0;4}: [Point(0, 0, 6), Point(4.285714286, 0, 12), Point(8.571428571, 0, 18), Point(12.85714286, 0, 24), Point(17.14285714, 0, 30), Point(21.42857143, 0, 36), Point(25.71428571, 0, 42)], {0;5}: [Point(-8.571428571, 0, 6), Point(-4.285714286, 0, 12), Point(0, 0, 18), Point(4.285714286, 0, 24), Point(8.571428571, 0, 30), Point(12.85714286, 0, 36), Point(17.14285714, 0, 42), Point(21.42857143, 0, 48), Point(25.71428571, 0, 54)], {0;6}: [Point(-17.14285714, 0, 6), Point(-12.85714286, 0, 12), Point(-8.571428571, 0, 18), Point(-4.285714286, 0, 24), Point(0, 0, 30), Point(4.285714286, 0, 36), Point(8.571428571, 0, 42), Point(12.85714286, 0, 48), Point(17.14285714, 0, 54), Point(21.42857143, 0, 60), Point(25.71428571, 0, 66)]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))
X_2 = UnitX(Factor=1)
move_2 = Move(Geometry=ptfaces, Motion=expr("x*-30", X_2))  # -> Geometry, Transform
incurve = PointInCurve(Point=center_points, Curve=project.Geometry)  # -> Relationship, Point
topoly = CurveToPolyline(Curve=project.Geometry, ToleranceDistance=0, ToleranceAngle=0)  # -> Polyline, Segments
dispatch = Dispatch(List=center_points, DispatchPattern=incurve.Relationship)  # -> ListA, ListB
pcen = PolygonCenter(Polyline=topoly.Polyline)  # -> CenterV, CenterE, CenterA
dispatch_2 = Dispatch(List=move_2.Geometry, DispatchPattern=incurve.Relationship)  # -> ListA, ListB
geo = Geometry(pcen.CenterE)
geo_2 = Geometry(pcen.CenterV)
index = ItemIndex(List=center_points, Item=dispatch.ListA)
geo_3 = Geometry(dispatch_2.ListA)
geo_4 = Geometry(dispatch_2.ListB)
item_13 = ListItem(List=move_2.Geometry, Index=index, Wrap=True)
area = Area(Geometry=geo_3)  # -> Area, Centroid
area_2 = Area(Geometry=item_13)  # -> Area, Centroid
dist = Distance(PointA=geo, PointB=area_2.Centroid)
vec2pt = Vector2Pt(PointA=area.Centroid, PointB=geo, Unitize=False)  # -> Vector, Length
vec2pt_2 = Vector2Pt(PointA=area_2.Centroid, PointB=geo, Unitize=False)  # -> Vector, Length
devec = DeconstructVector(Vector=vec2pt.Vector)  # -> XComponent, YComponent, ZComponent
devec_2 = DeconstructVector(Vector=vec2pt_2.Vector)  # -> XComponent, YComponent, ZComponent
dist_2 = Distance(PointA=geo, PointB=area.Centroid)
panel_3 = Panel(dist)
number = Number(-1)
_1 = Number(1)
addition = Addition(A=devec_2.XComponent, B=devec_2.YComponent)
bnd = Bounds(Numbers=flatten(devec.XComponent))
dom = ConstructDomain(DomainStart=number, DomainEnd=_1)
remap = RemapNumbers(Value=devec.XComponent, Source=bnd, Target=dom)  # -> Mapped, Clipped
ln = NaturalLogarithm(Value=addition)
_90 = Number(90)
number_2 = Number(-90)
panel_4 = Panel(remap.Mapped)
multiplication = Multiplication(A=remap.Mapped, B=dist_2)
dom_2 = ConstructDomain(DomainStart=number_2, DomainEnd=_90)
bnd_2 = Bounds(Numbers=flatten(multiplication))
panel_5 = Panel(multiplication)
remap_2 = RemapNumbers(Value=multiplication, Source=bnd_2, Target=dom_2)  # -> Mapped, Clipped
subtraction = Subtraction(A=90, B=remap_2.Mapped)
subtraction_2 = Subtraction(A=90, B=remap_2.Mapped)  # -> flatten(Result)
Z_3 = UnitZ(Factor=1)
rad_2 = Radians(Degrees=subtraction)
panel_6 = Panel(subtraction)
panel_7 = Panel(subtraction_2)
rot3d_2 = Rotate3D(Geometry=geo_3, Angle=rad_2, Center=area.Centroid, Axis=Z_3)  # -> Geometry, Transform
item_14 = ListItem(List=panel_7, Index=0, Wrap=True)  # -> Item, Item1, Item2, Item3, Item4, Item5, Item6, Item7
toggle = BooleanToggle(True)
ports_available = COMPortsAvailable()
_5 = Number(5)
_4 = Number(4)
_6 = Number(6)
open_port = OpenClosePort(OpenClosePort=toggle, PortNumber=_5, BaudRate=115200)
open_port_2 = OpenClosePort(OpenClosePort=toggle, PortNumber=_4, BaudRate=115200)
open_port_3 = OpenClosePort(OpenClosePort=toggle, PortNumber=_6, BaudRate=115200)
toggle_2 = BooleanToggle(True)
toggle_3 = BooleanToggle(True)
toggle_4 = BooleanToggle(True)
toggle_5 = BooleanToggle(True)
uno_write = UnoWrite(
    StartWritingValues=toggle_2,
    DigitalPin13=toggle_4,
    DigitalPin12=item_14.Item2,
    DigitalPin11=0,
    DigitalPin10=0,
    DigitalPin9=0,
    DigitalPin8=0,
    DigitalPin6=0,
    DigitalPin5=0,
    DigitalPin3=0,
    PortNumber=_5)  # -> ArduinoOutput, StatusMessage
uno_write_2 = UnoWrite(
    StartWritingValues=toggle_2,
    DigitalPin13=toggle_4,
    DigitalPin12=item_14.Item1,
    DigitalPin11=0,
    DigitalPin10=0,
    DigitalPin9=0,
    DigitalPin8=0,
    DigitalPin6=0,
    DigitalPin5=0,
    DigitalPin3=0,
    PortNumber=_4)  # -> ArduinoOutput, StatusMessage
uno_write_3 = UnoWrite(
    StartWritingValues=toggle_2,
    DigitalPin13=0,
    DigitalPin12=item_14.Item3,
    DigitalPin11=item_14.Item6,
    DigitalPin10=0,
    DigitalPin9=0,
    DigitalPin8=0,
    DigitalPin6=0,
    DigitalPin5=0,
    DigitalPin3=0,
    PortNumber=_6)  # -> ArduinoOutput, StatusMessage
