# Grasshopper definition 2016_9_14_Lorgan Arduino INSTALLED.gh (Grasshopper 0.9.76)
# plug-ins: Firefly.X, Kangaroo Components, PTComponentLibrary, Weaverbird, Firefly.Kinect.V1, Firefly.Core

# ----
# Set over-all dimensions
# and the number of diamonds
total_length_in = Slider(60, range=0..96)
total_height_in = Slider(84, range=0..96)
number_slider = Slider(14, range=0..20)
number_slider_2 = Slider(16, range=0..24)
division = Division(A=total_height_in, B=number_slider)
division_2 = Division(A=total_length_in, B=number_slider_2)

# ----
# EXTRACTING POINT DATA
number_slider_3 = Slider(40, range=0..50)
skeleton = KinectV1SkeletalTracker(
    StartSkeletonTracker=True,
    SkeletonScaleFactor=number_slider_3,
    TranslateInZAxis=Slider(36, range=0..50),
    TimerIntervalInMillisecondsForUpdatingEvents=5)  # -> Points, JointID, Bones
group = Group(Objects=skeleton.Points)
depth_stream = KinectV1DepthStream(ShowFalsecolor=True)

pt = Point(Tree({0;0;0}: [Point(11.02178371, 55.24815205, 3.873679491), Point(11.02723074, 55.28591517, 6.212185898), Point(11.05446374, 55.94946395, 17.6522966), Point(10.20195043, 53.55712961, 23.87901892), Point(5.15297842, 56.46029965, 14.94670377), Point(2.724770308, 57.66146283, 5.369177081)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], {0;1;0}: [Point(12.24285998, 61.38439238, 4.306436815), Point(12.24700707, 61.4327497, 6.902412294), Point(12.26426411, 62.20842207, 19.60229937), Point(11.3223311, 59.59663952, 26.49501852), Point(5.725357897, 62.79760815, 16.60015094), Point(3.025005627, 64.1271966, 5.997573055)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], {0;2;0}: [Point(12.26760223, 61.51724394, 4.317384448), Point(12.27154707, 61.57487924, 6.915667441), Point(12.28727924, 62.40869784, 19.62603625), Point(11.34238169, 59.82288249, 26.51151739), Point(5.755397794, 63.03150742, 16.60992777), Point(3.080971764, 64.38768337, 5.978587813)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], {0;3;0}: [Point(12.2924474, 61.615439, 4.333154237), Point(12.29540071, 61.67818621, 6.928778305), Point(12.30700754, 62.54355887, 19.62566983), Point(11.37770598, 60.1116074, 26.50018981), Point(5.822482419, 63.39179837, 16.60495766), Point(3.214320265, 64.79863279, 5.941562435)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], {0;4;0}: [Point(12.43397718, 62.10833987, 4.40042998), Point(12.44461388, 62.21659804, 6.98673933), Point(12.49428644, 63.32571334, 19.61574033), Point(11.56460242, 61.02027315, 26.4613902), Point(6.072551486, 64.30032624, 16.59606242), Point(3.61803532, 65.82327327, 5.778155177)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], {0;5;0}: [Point(12.66734541, 63.00877606, 4.382480021), Point(12.68041167, 63.0922404, 6.969489131), Point(12.74937521, 64.09361528, 19.60926899), Point(11.78613325, 61.7900585, 26.41049746), Point(6.375655549, 65.14374488, 16.62048437), Point(3.993895358, 66.52743054, 5.612688836)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]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))
group_2 = Group(Objects=pt)  # -> flatten(Group)
number_slider_4 = Slider(82, range=0..100)  # disabled
dup = DuplicateData(Data=0, Number=97, Order=True)  # disabled
int = Integer(1)  # disabled

# ----
# FRAME GEOMETRY
number_slider_5 = Slider(0.5, range=0..1)
l1 = End(0.75)
thickness = End(0.75)
number_slider_6 = Slider(15, range=0..24)
swatch = ColourSwatch(SwatchColor=RGB(64, 64, 64))

# ----
# PANEL GEOMETRY
Z = UnitZ(Factor=1)

# ----
# Create planes for
# mirrored panels
ptplanar = PlanarGrid(
    BasePoint=Point(0, 0, 0),
    IDir=Vector(1, 0, 0),
    JDir=Z,
    IDistance=division,
    JDistance=division_2,
    INumber=expr("x+1", number_slider),
    JNumber=expr("x+1", number_slider_2))
pttodiamond = ConvertToDiamond(Grid=ptplanar)
ptfaces = GenerateFaces(Grid=pttodiamond, PanelShape=0)
X = UnitX(Factor=1)
move = Move(Geometry=ptfaces, Motion=expr("x*-30", X))  # -> Geometry, Transform

# ---- group: reorder points into columns and then sort vertically
area = Area(Geometry=move.Geometry)  # -> Area, Centroid
pdecon = Deconstruct(Point=area.Centroid)  # -> XComponent, YComponent, ZComponent
split = TextSplit(Text=pdecon.ZComponent, Separators=".")
item = ListItem(List=split, Index=0, Wrap=True)
cset = CreateSet(List=flatten(item))  # -> Set, Map
sort = SortList(Keys=cset.Set)  # -> graft(Keys), ValuesA
equals = Equality(FirstNumber=flatten(item), SecondNumber=sort.Keys)  # -> Equality, Inequality
dispatch = Dispatch(List=flatten(move.Geometry), DispatchPattern=equals.Equality)  # -> ListA, ListB
srf = Surface(dispatch.ListA)
area_2 = Area(Geometry=srf)  # -> Area, Centroid
pdecon_2 = Deconstruct(Point=area_2.Centroid)  # -> XComponent, YComponent, ZComponent
sort_2 = SortList(Keys=pdecon_2.XComponent, ValuesA=srf)  # -> Keys, ValuesA

# ----
panelsrfs = Surface(sort_2.ValuesA)

panelsrfs_2 = Surface(panelsrfs)
join = BrepJoin(Breps=flatten(panelsrfs_2))  # -> Breps, Closed
fmerge = MergeFaces(Brep=join.Breps)  # -> Breps, Before, After
crv = Curve(fmerge.Breps)
offset = Offset(Curve=crv, Distance=number_slider_5, Plane=PlaneXY(0, 0, 0), Corners=1)
bbox = BoundingBox(Content=offset, Plane=PlaneXY(0, 0, 0))  # -> Box, Box_2
debrep = DeconstructBrep(Brep=bbox.Box)  # -> Faces, Edges, Vertices
offset_2 = Offset(Curve=debrep.Faces, Distance=expr("x", Slider(2, range=0..12)), Plane=PlaneXY(0, 0, 0), Corners=1)
explode = Explode(Curve=offset, Recursive=True)  # -> Segments, Vertices
explode_2 = Explode(Curve=offset_2, Recursive=True)  # -> Segments, Vertices
hull = ConvexHull(Points=explode_2.Vertices, Plane=offset_2)  # -> Hull, HullZ, Indices
explode_3 = Explode(Curve=hull.HullZ, Recursive=True)  # -> Segments, Vertices
shift = ShiftList(List=explode_3.Vertices, Shift=-1, Wrap=False)  # -> graft(List)
crv_cp = CurveClosestPoint(Point=shift, Curve=explode.Segments)  # -> Point, Parameter, Distance
sort_3 = SortList(Keys=crv_cp.Distance, ValuesA=explode.Segments)  # -> Keys, ValuesA
item_2 = ListItem(List=sort_3.ValuesA, Index=0, Wrap=True)
curvepoint = PointOnCurve(item_2, parameter=0.5)
crv_cp_2 = CurveClosestPoint(Point=flatten(curvepoint), Curve=offset)  # -> Point, Parameter, Distance
shift_2 = ShiftList(List=explode_3.Segments, Shift=-1, Wrap=True)  # -> simplify(graft(List))
shatter = Shatter(Curve=offset, Parameters=crv_cp_2.Parameter)  # -> simplify(graft(Segments))
fillet = Fillet(Curve=shatter, Radius=Slider(0.25, range=0..1))
crv_2 = Curve(shift_2)
item_3 = ListItem(List=flatten(crv_2), Index=0, Wrap=True)  # -> Item, Item1, Item2, Item3
end = EndPoints(Curve=shift_2)  # -> Start, End
end_2 = EndPoints(Curve=fillet)  # -> Start, End
crv_3 = Curve(simplify(graft([item_3.Item1, item_3.Item3])))
crv_4 = Curve([item_3.Item, item_3.Item2])
ln = Line(StartPoint=end_2.Start, EndPoint=end.Start)  # -> simplify(Line)
ln_2 = Line(StartPoint=end_2.End, EndPoint=end.End)  # -> simplify(Line)
ext = ExtendCurve(Curve=crv_4, Type=0, Start=l1, End=l1)  # -> simplify(graft(Curve))
join_2 = JoinCurves(Curves=[ln, ln_2, fillet, shift_2], Preserve=False)
boundary = BoundarySurfaces(Edges=join_2)
offset_3 = Offset(Curve=ext, Distance=thickness, Plane=offset_2, Corners=1)  # -> simplify(Curve)
offset_4 = Offset(Curve=crv_3, Distance=thickness, Plane=offset_2, Corners=1)  # -> simplify(Curve)
loft = Loft(Curves=[ext, offset_3], Options={Adjust=False, Closed=False, LoftEnds=0, LoftSimp=0, LoftType=0, Rebuild=10, Refit=0.01})
loft_2 = Loft(
    Curves=[crv_3, offset_4],
    Options={Adjust=False, Closed=False, LoftEnds=0, LoftSimp=0, LoftType=0, Rebuild=10, Refit=0.01})
amp = Amplitude(Vector=boundary, Amplitude=thickness)
move_2 = Move(Geometry=boundary, Motion=expr("-x*.5", amp))  # -> Geometry, Transform
amp_2 = Amplitude(Vector=loft, Amplitude=number_slider_6)
amp_3 = Amplitude(Vector=loft, Amplitude=number_slider_6)
move_3 = Move(Geometry=loft, Motion=expr("-x*.5", amp_2))  # -> Geometry, Transform
move_4 = Move(Geometry=loft_2, Motion=expr("-x*.5", amp_3))  # -> Geometry, Transform
extr = Extrude(Base=move_2.Geometry, Direction=amp)
extr_2 = Extrude(Base=move_3.Geometry, Direction=amp_2)
extr_3 = Extrude(Base=move_4.Geometry, Direction=amp_3)
preview = CustomPreview(Geometry=extr, Shader=swatch)
preview_2 = CustomPreview(Geometry=extr_2, Shader=swatch)
preview_3 = CustomPreview(Geometry=extr_3, Shader=swatch)

flip = FlipMatrix(Data=sort_2.ValuesA)

# ----
# Make dims to show size of each panel
edges = BrepEdges(Brep=panelsrfs)  # -> simplify(Naked), Interior, NonManifold
item_4 = ListItem(List=edges.Naked, Index=0, Wrap=True)  # -> Item, Item1, Item2, Item3
ccx = CurveCurve(CurveA=item_4.Item, CurveB=item_4.Item1)  # -> flatten(Points), ParamsA, ParamsB
points = PointList(Points=ccx.Points, Size=Slider(2, range=0..30))
number_slider_7 = Slider(1.586, range=0..18)
item_5 = ListItem(List=ccx.Points, Index=60, Wrap=True)
item_6 = ListItem(List=ccx.Points, Index=71, Wrap=True)
item_7 = ListItem(List=ccx.Points, Index=60, Wrap=True)
item_8 = ListItem(List=ccx.Points, Index=45, Wrap=True)
xz = XZPlane(Origin=Point(0, 0, 0))
aligndim = AlignedDimension(Plane=xz, PointA=item_5, PointB=item_6, Offset=Slider(0, range=-18..0), Text="{0:0.00}", Size=number_slider_7)
aligndim_2 = AlignedDimension(Plane=xz, PointA=item_7, PointB=item_8, Offset=Slider(0, range=0..30), Text="{0:0.00}", Size=number_slider_7)

# ----
# Total number of panels
geo = Geometry(flatten(panelsrfs))
lng = ListLength(List=geo)
panel = Panel(lng)

preview_4 = CustomPreview(Geometry=panelsrfs, Shader=ColourSwatch(SwatchColor=RGBA(242, 244, 252, 214)))

# ----
# MECHANICS GEOMETRY
Y = UnitY(Factor=0.2)  # disabled
number_slider_8 = Slider(-0.5, range=-1..0)  # disabled
number_slider_9 = Slider(0.563, range=0..1)  # disabled
number_slider_10 = Slider(0.92717, range=0..1)  # disabled
X_2 = UnitX(Factor=expr("-x", number_slider_9))  # disabled
X_3 = UnitX(Factor=number_slider_9)  # disabled
number_slider_11 = Slider(0.895, range=0..1)  # disabled
number_slider_12 = Slider(0.458, range=0..1)  # disabled
number_slider_13 = Slider(1.25, range=0..2)  # disabled
N = Count(2)  # disabled
N_2 = Count(2)  # disabled
N_3 = Count(2)  # disabled
dom = ConstructDomain(DomainStart=expr("-x*.5", number_slider_12), DomainEnd=expr("x*.5", number_slider_12))  # disabled
dom_2 = ConstructDomain(DomainStart=expr("-x*.5", number_slider_11), DomainEnd=expr("x*.5", number_slider_11))  # disabled
dom_3 = ConstructDomain(DomainStart=expr("-x*.5", number_slider_13), DomainEnd=expr("x*.5", number_slider_13))  # disabled
Z_2 = UnitZ(Factor=1)  # disabled
Z_3 = UnitZ(Factor=1)  # disabled
Z_4 = UnitZ(Factor=1)  # disabled
number_slider_14 = Slider(0.219, range=0..1)  # disabled
Y_2 = UnitY(Factor=1)  # disabled
range = Range(Domain=Domain(0, 1), Steps=N)  # disabled
range_2 = Range(Domain=Domain(0, 1), Steps=N_2)  # disabled
range_3 = Range(Domain=Domain(0, 1), Steps=N_3)  # disabled
number_slider_15 = Slider(0.2101, range=0..1)  # disabled
number_slider_16 = Slider(0.15, range=0..1)  # disabled
number_slider_17 = Slider(0.05, range=0..1)  # disabled
number_slider_18 = Slider(0.125, range=0..1)  # disabled
number_slider_19 = Slider(0.25, range=0..1)  # disabled
number_slider_20 = Slider(0.1, range=0..1)  # disabled
graph = GraphMapper(range, x0=0, x1=0.5, y0=0, y1=1, container_name="Sine", Equation_px=[0, 1], Equation_py=[0, 1])  # disabled
graph_2 = GraphMapper(range_2, x0=0, x1=0.5, y0=0, y1=1, container_name="Sine", Equation_px=[0, 1], Equation_py=[0, 1])  # disabled
Y_3 = UnitY(Factor=expr("-x", 0.06))  # disabled
graph_3 = GraphMapper(range_3, x0=0, x1=0.5, y0=0, y1=1, container_name="Sine", Equation_px=[0, 1], Equation_py=[0, 1])  # disabled
Y_4 = UnitY(Factor=expr("-x", number_slider_14))  # disabled
bnd = Bounds(Numbers=graph)  # disabled
dom_4 = ConstructDomain(DomainStart=number_slider_16, DomainEnd=number_slider_15)  # disabled
bnd_2 = Bounds(Numbers=graph_2)  # disabled
dom_5 = ConstructDomain(DomainStart=number_slider_18, DomainEnd=number_slider_17)  # disabled
bnd_3 = Bounds(Numbers=graph_3)  # disabled
dom_6 = ConstructDomain(DomainStart=number_slider_20, DomainEnd=number_slider_19)  # disabled
remap = RemapNumbers(Value=graph, Source=bnd, Target=dom_4)  # -> Mapped, Clipped; disabled
remap_2 = RemapNumbers(Value=graph_2, Source=bnd_2, Target=dom_5)  # -> Mapped, Clipped; disabled
Y_5 = UnitY(Factor=1)  # disabled
remap_3 = RemapNumbers(Value=graph_3, Source=bnd_3, Target=dom_6)  # -> Mapped, Clipped; disabled
amp_4 = Amplitude(Vector=Y_2, Amplitude=remap.Mapped)  # disabled
number_slider_21 = Slider(0.2, range=0..1)  # disabled
D = Degree(1)  # disabled
D_2 = Degree(1)  # disabled
D_3 = Degree(1)  # disabled
X_4 = UnitX(Factor=1)  # disabled
number_slider_22 = Slider(-0.05, range=-1..0)  # disabled
number_slider_23 = Slider(0.143, range=0..1)  # disabled
number_slider_24 = Slider(0.065, range=0..1)  # disabled
number_slider_25 = Slider(1, range=0..1)  # disabled
number_slider_26 = Slider(1.298, range=0..3)  # disabled
Y_6 = UnitY(Factor=1)  # disabled
number_slider_27 = Slider(0.674, range=0..1)  # disabled
number_slider_28 = Slider(0.224, range=0..1)  # disabled
swatch_2 = ColourSwatch(SwatchColor=RGB(130, 130, 130))  # disabled

panelsrfs_3 = Surface(panelsrfs)
debrep_2 = DeconstructBrep(Brep=panelsrfs_3)  # -> Faces, Edges, Vertices
area_3 = Area(Geometry=debrep_2.Faces)  # -> Area, Centroid
pshift = ShiftPaths(Data=debrep_2.Vertices, Offset=-1)
item_9 = ListItem(List=pshift, Index=0, Wrap=True)
crv_5 = Curve([item_3.Item, item_3.Item2])
curvepoint_2 = PointOnCurve(crv_5, parameter=0.5)
brackettorodoffset = Slider(1.5, range=0..5)
bracketoffset = Slider(0.375, range=0..5)
Y_7 = UnitY(Factor=bracketoffset)
Y_8 = UnitY(Factor=brackettorodoffset)

item_10 = ListItem(List=debrep_2.Vertices, Index=0, Wrap=True)
pshift_2 = ShiftPaths(Data=item_10, Offset=-1)

project = Project(Geometry=item_10, Plane=curvepoint_2)  # -> Geometry, Transform
pline = PolyLine(Vertices=project.Geometry, Closed=False)
move_5 = Move(Geometry=pline, Motion=Y_7)  # -> Geometry, Transform
move_6 = Move(Geometry=move_5.Geometry, Motion=Y_8)  # -> Geometry, Transform
crv_cp_3 = CurveClosestPoint(Point=area_3.Centroid, Curve=move_6.Geometry)  # -> graft(Point), Parameter, Distance
crv_cp_4 = CurveClosestPoint(Point=area_3.Centroid, Curve=move_5.Geometry)  # -> simplify(graft(Point)), Parameter, Distance
pipe = Pipe(Curve=move_6.Geometry, Radius=0.125, Caps=0)
mesh = Mesh(pipe)
ln_3 = Line(StartPoint=crv_cp_4.Point, EndPoint=crv_cp_3.Point)
preview_5 = CustomPreview(Geometry=mesh, Shader=ColourSwatch(SwatchColor=RGB(181, 181, 181)))
connectorcenterline = Curve(ln_3)
diamondcenterpt = Point(crv_cp_4.Point)

pshift_3 = ShiftPaths(Data=item_10, Offset=-1)
diamondcenterpt_2 = Point(diamondcenterpt)

diamondcenterpts = Point(diamondcenterpt)  # disabled
connectorcenterline_2 = Curve(connectorcenterline)  # disabled
brackettorodoffset_2 = Number(brackettorodoffset)  # disabled
move_7 = Move(Geometry=diamondcenterpts, Motion=expr("-x", Y))  # -> Geometry, Transform; disabled
move_8 = Move(Geometry=diamondcenterpts, Motion=Y)  # -> Geometry, Transform; disabled
ext_2 = ExtendCurve(Curve=connectorcenterline_2, Type=0, Start=0, End=brackettorodoffset_2)  # disabled
curvepoint_3 = PointOnCurve(connectorcenterline_2, parameter=1)  # disabled
eval = EvaluateCurve(Curve=reparameterize(ext_2), Parameter=number_slider_10)  # -> Point, Tangent, Angle; disabled
divide = DivideCurve(Curve=ext_2, Count=N_3, Kinks=False)  # -> Points, Tangents, Parameters; disabled
rectangle = Rectangle(Plane=eval.Point, XSize=dom, YSize=dom_2, Radius=0)  # -> simplify(Rectangle), Length; disabled
rectangle_2 = Rectangle(Plane=eval.Point, XSize=dom, YSize=dom_3, Radius=0)  # -> Rectangle, Length; disabled
explode_4 = Explode(Curve=rectangle.Rectangle, Recursive=True)  # -> Segments, Vertices; disabled
xprod = CrossProduct(VectorA=divide.Tangents, VectorB=Z_4, Unitize=False)  # -> Vector, Length; disabled
item_11 = ListItem(List=explode_4.Segments, Index=2, Wrap=True)  # disabled
curvepoint_4 = PointOnCurve(item_11, parameter=0.5)  # disabled
move_9 = Move(Geometry=curvepoint_4, Motion=Y_4)  # -> Geometry, Transform; disabled
amp_5 = Amplitude(Vector=xprod.Vector, Amplitude=remap_3.Mapped)  # disabled
move_10 = Move(Geometry=divide.Points, Motion=expr("-x", amp_5))  # -> Geometry, Transform; disabled
item_12 = ListItem(List=reverse(divide.Points), Index=0, Wrap=True)  # disabled
pt_2 = Point(item_12)  # disabled
move_11 = Move(Geometry=pt_2, Motion=[X_3, X_2])  # -> Geometry, Transform; disabled
cir = Circle(Plane=move_11.Geometry, Radius=0.01)  # -> simplify(Circle); disabled
item_13 = ListItem(List=divide.Points, Index=0, Wrap=True)  # disabled
move_12 = Move(Geometry=divide.Points, Motion=amp_5)  # -> Geometry, Transform; disabled
cir_2 = Circle(Plane=curvepoint_3, Radius=0.13)  # -> simplify(Circle); disabled
cir_3 = Circle(Plane=item_13, Radius=number_slider_24)  # -> simplify(Circle); disabled
intcrv = Interpolate(Vertices=move_12.Geometry, Degree=D_3, Periodic=False, KnotStyle=1)  # -> simplify(Curve), Length, Domain; disabled
intcrv_2 = Interpolate(Vertices=move_10.Geometry, Degree=D_3, Periodic=False, KnotStyle=1)  # -> simplify(Curve), Length, Domain; disabled
curvepoint_5 = PointOnCurve(cir_2, parameter=0.75)  # disabled
curvepoint_6 = PointOnCurve(cir_2, parameter=0.25)  # disabled
flip_2 = FlipCurve(Curve=intcrv.Curve)  # -> Curve, Flag; disabled
flip_3 = FlipCurve(Curve=intcrv_2.Curve)  # -> Curve, Flag; disabled
line = LineSDL(Start=[curvepoint_6, curvepoint_5], Direction=X_4, Length=1)  # disabled
loft_3 = Loft(Curves=line, Options={Adjust=False, Closed=False, LoftEnds=0, LoftSimp=0, LoftType=0, Rebuild=10, Refit=0.01})  # disabled
eval_2 = EvaluateCurve(Curve=reparameterize([intcrv.Curve, intcrv_2.Curve]), Parameter=number_slider_23)  # -> Point, Tangent, Angle; disabled
blendc = BlendCurve(CurveA=intcrv.Curve, CurveB=flip_3.Curve, BulgeA=1, BulgeB=1, Continuity=2)  # -> simplify(Blend); disabled
blendc_2 = BlendCurve(CurveA=flip_2.Curve, CurveB=intcrv_2.Curve, BulgeA=1, BulgeB=1, Continuity=2)  # -> simplify(Blend); disabled
curvepoint_7 = PointOnCurve(ext_2, parameter=1)  # disabled
item_14 = ListItem(List=move_12.Geometry, Index=1, Wrap=True)  # disabled
item_15 = ListItem(List=move_10.Geometry, Index=1, Wrap=True)  # disabled
vec2pt = Vector2Pt(PointA=diamondcenterpts, PointB=curvepoint_7, Unitize=False)  # -> Vector, Length; disabled
join_3 = JoinCurves(Curves=[blendc, blendc_2, intcrv.Curve, intcrv_2.Curve], Preserve=False)  # -> simplify(Curves); disabled
line_2 = LineSDL(Start=[item_14, item_15], Direction=eval_2.Tangent, Length=number_slider_26)  # -> simplify(Line); disabled
ln_4 = Line(StartPoint=item_14, EndPoint=item_15)  # -> simplify(Line); disabled
curvepoint_8 = PointOnCurve(line_2, parameter=1)  # disabled
line_3 = LineSDL(Start=curvepoint_8, Direction=reverse(eval_2.Tangent), Length=number_slider_27)  # -> simplify(Line); disabled
item_16 = ListItem(List=line_3, Index=0, Wrap=True)  # -> Item, Item1; disabled
flip_4 = FlipCurve(Curve=item_16.Item1)  # -> Curve, Flag; disabled
blendc_3 = BlendCurve(CurveA=item_16.Item, CurveB=flip_4.Curve, BulgeA=number_slider_28, BulgeB=number_slider_28, Continuity=2)  # -> simplify(Blend); disabled
join_4 = JoinCurves(Curves=[blendc_3, line_3, line_2, ln_4], Preserve=False)  # -> simplify(Curves); disabled
runion = RegionUnion(Curves=[join_3, join_4])  # disabled
rdiff = RegionDifference(CurvesA=runion, CurvesB=[loft_3, cir_2])  # -> simplify(Result); disabled
boundary_2 = BoundarySurfaces(Edges=[rdiff, cir_3, rectangle.Rectangle])  # disabled

# ----
# Transforms on the skeletal point set
# to adjust for weird angles and z-offsets
Z_5 = UnitZ(Factor=Slider(24, range=0..96))
rad = Radians(Degrees=Slider(-9, range=-90..0))
X_5 = UnitX(Factor=1)

# ----
# Making the projected area
# that defines the presence of
# a person
xz_2 = XZPlane(Origin=Point(0, 0, 0))

# ---- group: buttonRotations
# Button data coming in from ESP
# BUTTON PRESS
# DATA COMING IN
# VIA WIFI
# Bool data going out to
# button input of definition
udp_listener = UDPListener(Port=6001)
panel_2 = Panel(udp_listener)
split_2 = TextSplit(Text=panel_2, Separators=",")

# ---- group: patternRotations
diamondcenterpt_3 = Point(diamondcenterpt)
pshift_4 = ShiftPaths(Data=simplify(diamondcenterpt_3), Offset=-1)
diamondcenterpt_4 = Point(reverse(flatten(pshift_4)))
diamondcenterpt_5 = Point(reverse(flatten(pshift_4)))
diamondcenterpt_6 = Point(flatten(pshift_4))
diamondcenterpt_7 = Point(flatten(diamondcenterpt_3))
lng_2 = ListLength(List=diamondcenterpt_5)  # -> expr("(x*.5)-4", Length)
item_17 = ListItem(List=reverse(diamondcenterpt_7), Index=0, Wrap=True)
item_18 = ListItem(List=reverse(diamondcenterpt_5), Index=lng_2, Wrap=True)
item_19 = ListItem(List=reverse(diamondcenterpt_4), Index=0, Wrap=True)
item_20 = ListItem(List=diamondcenterpt_7, Index=0, Wrap=True)
item_21 = ListItem(List=diamondcenterpt_6, Index=0, Wrap=True)
item_22 = ListItem(List=diamondcenterpt_5, Index=lng_2, Wrap=True)
item_23 = ListItem(List=diamondcenterpt_4, Index=0, Wrap=True)
avr = Average(Input=diamondcenterpt_6)
ln_5 = Line(StartPoint=item_20, EndPoint=item_17)
ln_6 = Line(StartPoint=item_21, EndPoint=avr)
ln_7 = Line(StartPoint=item_22, EndPoint=item_18)
ln_8 = Line(StartPoint=item_18, EndPoint=item_22)
ln_9 = Line(StartPoint=item_23, EndPoint=item_19)
crv_6 = Curve([ln_5, ln_9, ln_7, ln_8, ln_6])
range_4 = Range(Domain=Domain(0, 1), Steps=4)
num = Number(reverse(range_4))
shift_3 = ShiftList(List=num, Shift=1, Wrap=False)
shift_4 = ShiftList(List=shift_3, Shift=-1, Wrap=False)
num_2 = Number(flatten([range_4, shift_3]))
X_6 = UnitX(Factor=1)
dom_7 = ConstructDomain(DomainStart=Slider(0, range=-90..90), DomainEnd=Slider(-75, range=-90..90))

# ---- group: buttonRotations
attractorpanelindex = Index(0)
diamondcenterpt_8 = Point(diamondcenterpt)
diamondcenterpt_9 = Point(flatten(diamondcenterpt))
diamondcenterpt_10 = Point(diamondcenterpt)
item_24 = ListItem(List=reverse(flatten(diamondcenterpt_9)), Index=0, Wrap=True)
item_25 = ListItem(List=flatten(diamondcenterpt_9), Index=0, Wrap=True)
dist = Distance(PointA=item_25, PointB=item_24)
X_7 = UnitX(Factor=1)

# ----
lng_3 = ListLength(List=flatten(diamondcenterpt_8))
series = Series(Start=0, Step=1, Count=lng_3)

# ---- group: kinectRotations
maxangle = Slider(-75, range=-90..90)
X_8 = UnitX(Factor=1)
dom_8 = ConstructDomain(DomainStart=maxangle, DomainEnd=Slider(0, range=-90..90))

# ---- group: buttonRotations (continued)
dom_9 = ConstructDomain(DomainStart=Slider(0, range=-90..90), DomainEnd=maxangle)

# ----
timer = Timer(TimerInterval=100, Target=[counter, udp_listener])
counter = Counter(Reset=Toggle(False))
chars = Characters(Text=counter)  # -> reverse(Result), Unicode
item_26 = ListItem(List=chars.Result, Index=0, Wrap=True)  # -> Item, Item1
multiplication = Multiplication(A=counter, B=0.1)
_1x_counter = Integer(item_26.Item)

_10x_counter = Number(expr("floor(x)", multiplication))
_10x_counter_2 = Integer(_10x_counter)

item_27 = ListItem(List=group_2, Index=_10x_counter_2, Wrap=True)
move_13 = Move(Geometry=item_27, Motion=Z_5)  # -> Geometry, Transform
ungroup = Ungroup(Group=move_13.Geometry)
item_28 = ListItem(List=ungroup, Index=0, Wrap=True)
rot3d = Rotate3D(Geometry=ungroup, Angle=rad, Center=item_28, Axis=X_5)  # -> Geometry, Transform

# ---- group: neck
item_29 = ListItem(List=rot3d.Geometry, Index=Slider(2, range=0..20), Wrap=True)
project_2 = Project(Geometry=item_29, Plane=xz_2)  # -> Geometry, Transform

# ----
_10x_counter_3 = Integer(_10x_counter)  # disabled
shift_5 = ShiftList(List=flatten([int, dup]), Shift=_10x_counter_3, Wrap=True)  # disabled

# ---- group: buttonRotations (continued)
panel_3 = Panel(shift_5)
int_2 = Integer(graft(panel_3))

# ----
rec = DataRecorder(int_2, DataLimit=10, RecordData=True)

# ---- group: patternRotations (continued)
_10x_counter_4 = Integer(_10x_counter)
chars_2 = Characters(Text=_10x_counter_4)  # -> Result, Unicode
item_30 = ListItem(List=reverse(chars_2.Result), Index=0, Wrap=True)  # -> Item, Item1
division_3 = Division(A=item_30.Item, B=10)
item_31 = ListItem(List=[item_20, item_23, item_22, item_18, avr], Index=item_30.Item1, Wrap=True)
item_32 = ListItem(List=crv_6, Index=item_30.Item1, Wrap=True)
ln_10 = Line(StartPoint=diamondcenterpt_7, EndPoint=item_31)  # -> graft(Line)
dist_2 = Distance(PointA=diamondcenterpt_7, PointB=item_31)
item_33 = ListItem(List=num_2, Index=item_30.Item, Wrap=True)
eval_3 = EvaluateCurve(Curve=reparameterize(item_32), Parameter=item_33)  # -> Point, Tangent, Angle
dist_3 = Distance(PointA=eval_3.Point, PointB=item_31)
max = Maximum(A=dist_2, B=1)
devec = DeconstructVector(Vector=item_32)  # -> XComponent, YComponent, ZComponent
division_4 = Division(A=dist_3, B=max)
vec = VectorXYZ(XComponent=devec.XComponent, YComponent=0, ZComponent=0)  # -> Vector, Length
min = Minimum(A=division_4, B=1)
dprod = DotProduct(VectorA=vec.Vector, VectorB=X_6, Unitize=True)
remap_4 = RemapNumbers(Value=min, Source=Domain(0, 1), Target=dom_7)  # -> Mapped, Clipped
multiplication_2 = Multiplication(A=dprod, B=remap_4.Mapped)  # -> flatten(Result)
patternrotationvalues = Number(simplify(graft(multiplication_2)))

# ----
sort_4 = SortList(Keys=rec)  # -> Keys, ValuesA
item_34 = ListItem(List=reverse(sort_4.Keys), Index=0, Wrap=True)
dispatch_2 = Dispatch(List=graft(series), DispatchPattern=item_34)  # -> flatten(ListA), ListB

# ---- group: buttonRotations (continued)
item_35 = ListItem(List=flatten(diamondcenterpt_8), Index=dispatch_2.ListA, Wrap=True)
ln_11 = Line(StartPoint=diamondcenterpt_10, EndPoint=item_35)
len = Length(Curve=ln_11)
sort_5 = SortList(Keys=len, ValuesA=ln_11)  # -> Keys, ValuesA
item_36 = ListItem(List=sort_5.ValuesA, Index=0, Wrap=True)
len_2 = Length(Curve=item_36)
bnd_4 = Bounds(Numbers=flatten(len_2))
project_3 = Project(Geometry=item_36, Plane=PlaneXY(0, 0, 0))  # -> Geometry, Transform
dprod_2 = DotProduct(VectorA=project_3.Geometry, VectorB=X_7, Unitize=True)
remap_5 = RemapNumbers(Value=len_2, Source=dist, Target=dom_9)  # -> Mapped, Clipped
multiplication_3 = Multiplication(A=dprod_2, B=remap_5.Mapped)  # -> flatten(Result)
buttonrotationvalues = Number(simplify(graft(multiplication_3)))

# ---- group: buttons override pattern rotation values
buttonrotationvalues_2 = Number(flatten(buttonrotationvalues))
item_37 = ListItem(List=flatten(panel_3), Index=0, Wrap=True)
null = NullItem(Item=item_37)  # -> NullFlags, InvalidFlags, Description
dispatch_3 = Dispatch(List=buttonrotationvalues_2, DispatchPattern=null.NullFlags)  # -> ListA, simplify(ListB)

# ---- group: pattern is the screen saver overridden by everything else
patternrotationvalues_2 = Number(flatten(patternrotationvalues))
dispatch_4 = Dispatch(List=patternrotationvalues_2, DispatchPattern=null.NullFlags)  # -> simplify(ListA), ListB

# ----
hand_right = ListItem(List=rot3d.Geometry, Index=11, Wrap=True)
foot_right = ListItem(List=rot3d.Geometry, Index=19, Wrap=True)
hand_left = ListItem(List=rot3d.Geometry, Index=7, Wrap=True)
head = ListItem(List=rot3d.Geometry, Index=3, Wrap=True)
foot_left = ListItem(List=rot3d.Geometry, Index=15, Wrap=True)
intcrv_3 = Interpolate(Vertices=[hand_left, head, hand_right, foot_right, foot_left], Degree=3, Periodic=True, KnotStyle=1)  # -> Curve, Length, Domain
geo_2 = Geometry(project_2.Geometry)

ln_12 = Line(StartPoint=[hand_left, head, hand_right, foot_right, foot_left], EndPoint=item_29)

project_4 = Project(Geometry=ln_12, Plane=xz_2)  # -> Geometry, Transform
stickmancrvs = Curve(project_4.Geometry)

stickmancrvs_2 = Curve(stickmancrvs)
kinectpt = Point(geo_2)
crv_cp_5 = CurveClosestPoint(Point=diamondcenterpt_2, Curve=stickmancrvs_2)  # -> Point, Parameter, Distance
sort_6 = SortList(Keys=crv_cp_5.Distance)  # -> Keys, ValuesA
item_38 = ListItem(List=sort_6.Keys, Index=0, Wrap=True)

# ---- group: kinectRotations (continued)
ln_13 = Line(StartPoint=diamondcenterpt_2, EndPoint=kinectpt)
len_3 = Length(Curve=ln_13)
sort_7 = SortList(Keys=len_3, ValuesA=ln_13)  # -> Keys, ValuesA
item_39 = ListItem(List=sort_7.ValuesA, Index=0, Wrap=True)
bnd_5 = Bounds(Numbers=flatten(item_38))
project_5 = Project(Geometry=item_39, Plane=PlaneXY(0, 0, 0))  # -> Geometry, Transform
dprod_3 = DotProduct(VectorA=project_5.Geometry, VectorB=X_8, Unitize=True)
remap_6 = RemapNumbers(Value=item_38, Source=bnd_5, Target=dom_8)  # -> Mapped, Clipped
multiplication_4 = Multiplication(A=dprod_3, B=remap_6.Mapped)  # -> flatten(Result)
kinectrotationvalues = Number(simplify(graft(multiplication_4)))

# ---- group: kinect overrides all other rotation values
kinectrotationvalues_2 = Number(flatten(kinectrotationvalues))
kinectpt_2 = Point(kinectpt)
null_2 = NullItem(Item=kinectpt_2)  # -> NullFlags, InvalidFlags, Description

# ---- group: go to sleep if kinect or buttons are inactive for a set time
null_3 = NullItem(Item=kinectpt)  # -> flatten(NullFlags), InvalidFlags, Description
null_4 = NullItem(Item=item_37)  # -> flatten(NullFlags), InvalidFlags, Description
rec_2 = DataRecorder(null_3.NullFlags, DataLimit=300, RecordData=True)
rec_3 = DataRecorder(null_4.NullFlags, DataLimit=300, RecordData=True)
bool = Boolean(flatten(rec_3))
bool_2 = Boolean(flatten(rec_2))
sort_8 = SortList(Keys=[bool_2, bool])  # -> Keys, ValuesA
item_40 = ListItem(List=flatten(sort_8.Keys), Index=0, Wrap=True)

# ----
dispatch_5 = Dispatch(List=flatten([dispatch_3.ListB, dispatch_4.ListA]), DispatchPattern=null_2.NullFlags)  # -> simplify(graft(ListA)), ListB
dispatch_6 = Dispatch(List=kinectrotationvalues_2, DispatchPattern=null_2.NullFlags)  # -> ListA, simplify(graft(ListB))
dispatch_7 = Dispatch(List=[0, 0, 0, 0, 0, 0, 0, 0, 0, 0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], DispatchPattern=item_40)  # -> simplify(graft(ListA)), simplify(graft(ListB))
dispatch_8 = Dispatch(List=[dispatch_6.ListB, dispatch_5.ListA], DispatchPattern=item_40)  # -> ListA, simplify(graft(ListB))
clean = CleanTree(RemoveNulls=True, RemoveInvalid=True, RemoveEmpty=True, Tree=[dispatch_8.ListB, dispatch_7.ListA])
rotationangle = Number(clean)
valuestosmooth = Number(flatten(rotationangle))

valuestosmooth_2 = Number(simplify(graft(valuestosmooth)))
rec_4 = DataRecorder(valuestosmooth_2, DataLimit=10, RecordData=True)

item_41 = ListItem(List=rec_4, Index=0, Wrap=True)
oldvalue = Number(item_41)
old_value = Panel(oldvalue)
item_42 = ListItem(List=reverse(rec_4), Index=0, Wrap=True)
newvalue = Number(item_42)
new_value = Panel(newvalue)
dom_10 = ConstructDomain(DomainStart=oldvalue, DomainEnd=newvalue)
value_domain = Panel(dom_10)
range_5 = Range(Domain=dom_10, Steps=9)
value_range = Panel(range_5)
valueindex = Panel(_1x_counter)
item_43 = ListItem(List=range_5, Index=_1x_counter, Wrap=True)
currentvalue = Panel(item_43)

rotationangle_2 = Number(item_43)

# ---- group: preview rotations
panelsrfs_4 = Surface(graft(panelsrfs))
pcen = PolygonCenter(Polyline=panelsrfs_4)  # -> CenterV, CenterE, CenterA
rotate = Rotate(Geometry=graft(panelsrfs_4), Angle=graft(degrees(rotationangle_2)), Plane=pcen.CenterV)  # -> Geometry, Transform
material = CreateMaterial(
    Diffuse=ColourSwatch(SwatchColor=RGB(82, 107, 117)),
    Specular=RGB(255, 255, 255),
    Emission=RGB(0, 0, 0),
    Transparency=0,
    Shine=Slider(0.402, range=0..1))
mesh_2 = Mesh(rotate.Geometry)
wboffset = WeaverbirdsOffsetMesh(MeshCurves=mesh_2, Distance=0.5, OffsetType=0)
xz_3 = XZPlane(Origin=pcen.CenterV)
int_3 = Integer(rotationangle_2)
tag = TextTag(Location=xz_3, Text=graft(int_3))
preview_6 = CustomPreview(Geometry=mesh_2, Shader=material)
preview_7 = CustomPreview(Geometry=wboffset, Shader=ColourSwatch(SwatchColor=RGB(204, 0, 255)))

# ----
srf_2 = Surface(rotate.Geometry)  # disabled
explode_5 = Explode(Curve=srf_2, Recursive=True)  # -> Segments, Vertices; disabled
item_44 = ListItem(List=explode_5.Segments, Index=[2, 6], Wrap=True)  # disabled
curvepoint_9 = PointOnCurve(item_44, parameter=0.5)  # disabled
ln_14 = Line(StartPoint=move_7.Geometry, EndPoint=curvepoint_9)  # disabled
join_5 = JoinCurves(Curves=ln_14, Preserve=False)  # disabled
ext_3 = ExtendCurve(Curve=join_5, Type=0, Start=number_slider_8, End=number_slider_8)  # disabled
end_3 = EndPoints(Curve=join_5)  # -> Start, End; disabled
end_4 = EndPoints(Curve=ext_3)  # -> Start, End; disabled
srf_cp = SurfaceClosestPoint(Point=end_4.End, Surface=srf_2)  # -> Point, UVPoint, Distance; disabled
srf_cp_2 = SurfaceClosestPoint(Point=end_4.Start, Surface=srf_2)  # -> Point, UVPoint, Distance; disabled
ln_15 = Line(StartPoint=end_3.End, EndPoint=srf_cp.Point)  # disabled
ln_16 = Line(StartPoint=end_3.Start, EndPoint=srf_cp_2.Point)  # disabled
shatter_2 = Shatter(Curve=reparameterize([ln_16, ln_15]), Parameters=0.5)  # disabled
item_45 = ListItem(List=reverse(shatter_2), Index=0, Wrap=True)  # disabled
ln_17 = Line(StartPoint=[srf_cp.Point, srf_cp_2.Point], EndPoint=move_7.Geometry)  # -> reverse(simplify(graft(Line))); disabled
move_14 = Move(Geometry=item_45, Motion=Y_3)  # -> simplify(Geometry), Transform; disabled
curvepoint_10 = PointOnCurve(move_14.Geometry, parameter=0)  # disabled
curvepoint_11 = PointOnCurve(item_45, parameter=0)  # disabled
curvepoint_12 = PointOnCurve(move_14.Geometry, parameter=1)  # disabled
curvepoint_13 = PointOnCurve(ln_17, parameter=0)  # disabled
line_4 = LineSDL(Start=curvepoint_11, Direction=Y_5, Length=0.25)  # -> simplify(Line); disabled
curvepoint_14 = PointOnCurve(line_4, parameter=0.5)  # disabled
pshift_5 = ShiftPaths(Data=curvepoint_14, Offset=-1)  # disabled
ln_18 = Line(StartPoint=curvepoint_11, EndPoint=curvepoint_10)  # -> simplify(Line); disabled
ln_19 = Line(StartPoint=curvepoint_12, EndPoint=curvepoint_13)  # -> simplify(Line); disabled
ln_20 = Line(StartPoint=pshift_5, EndPoint=diamondcenterpts)  # -> simplify(Line); disabled
curvepoint_15 = PointOnCurve(line_4, parameter=1)  # disabled
eval_4 = EvaluateCurve(Curve=ln_20, Parameter=number_slider_21)  # -> Point, Tangent, Angle; disabled
vec2pt_2 = Vector2Pt(PointA=diamondcenterpts, PointB=eval_4.Point, Unitize=False)  # -> Vector, Length; disabled
move_15 = Move(Geometry=ext_2, Motion=vec2pt_2.Vector)  # -> Geometry, Transform; disabled
divide_2 = DivideCurve(Curve=move_15.Geometry, Count=N_2, Kinks=False)  # -> Points, Tangents, Parameters; disabled
xprod_2 = CrossProduct(VectorA=divide_2.Tangents, VectorB=Z_3, Unitize=False)  # -> Vector, Length; disabled
amp_6 = Amplitude(Vector=xprod_2.Vector, Amplitude=remap_2.Mapped)  # disabled
move_16 = Move(Geometry=divide_2.Points, Motion=expr("-x", amp_6))  # -> Geometry, Transform; disabled
item_46 = ListItem(List=reverse(divide_2.Points), Index=0, Wrap=True)  # disabled
pt_3 = Point(item_46)  # disabled
pshift_6 = ShiftPaths(Data=simplify(pt_3), Offset=-1)  # disabled
ln_21 = Line(StartPoint=pt_2, EndPoint=pshift_6)  # disabled
join_6 = JoinCurves(Curves=ln_21, Preserve=False)  # disabled
divide_3 = DivideCurve(Curve=join_6, Count=N, Kinks=False)  # -> Points, Tangents, Parameters; disabled
xprod_3 = CrossProduct(VectorA=divide_3.Tangents, VectorB=Z_2, Unitize=False)  # -> Vector, Length; disabled
item_47 = ListItem(List=divide_3.Points, Index=0, Wrap=True)  # -> Item, Item1, Item2; disabled
move_17 = Move(Geometry=divide_3.Points, Motion=expr("-x", amp_4))  # -> Geometry, Transform; disabled
move_18 = Move(Geometry=divide_3.Points, Motion=amp_4)  # -> Geometry, Transform; disabled
item_48 = ListItem(List=divide_2.Points, Index=0, Wrap=True)  # disabled
move_19 = Move(Geometry=divide_2.Points, Motion=amp_6)  # -> Geometry, Transform; disabled
curvepoint_16 = PointOnCurve(ln_20, parameter=0.451)  # disabled
cir_4 = Circle(Plane=item_47.Item1, Radius=0.13)  # -> simplify(Circle); disabled
cir_5 = Circle(Plane=[item_47.Item, item_47.Item2], Radius=number_slider_24)  # -> simplify(Circle); disabled
cir_6 = Circle(Plane=[item_48, item_46], Radius=number_slider_24)  # -> simplify(Circle); disabled
intcrv_4 = Interpolate(Vertices=move_18.Geometry, Degree=D, Periodic=False, KnotStyle=1)  # -> simplify(Curve), Length, Domain; disabled
intcrv_5 = Interpolate(Vertices=move_17.Geometry, Degree=D, Periodic=False, KnotStyle=1)  # -> simplify(Curve), Length, Domain; disabled
intcrv_6 = Interpolate(Vertices=move_19.Geometry, Degree=D_2, Periodic=False, KnotStyle=1)  # -> simplify(Curve), Length, Domain; disabled
intcrv_7 = Interpolate(Vertices=move_16.Geometry, Degree=D_2, Periodic=False, KnotStyle=1)  # -> simplify(Curve), Length, Domain; disabled
pshift_7 = ShiftPaths(Data=simplify(curvepoint_15), Offset=-1)  # disabled
flip_5 = FlipCurve(Curve=intcrv_6.Curve)  # -> Curve, Flag; disabled
flip_6 = FlipCurve(Curve=intcrv_7.Curve)  # -> Curve, Flag; disabled
ext_4 = ExtendCurve(Curve=intcrv_5.Curve, Type=0, Start=number_slider_22, End=number_slider_22)  # disabled
ext_5 = ExtendCurve(Curve=intcrv_4.Curve, Type=0, Start=number_slider_22, End=number_slider_22)  # disabled
ln_22 = Line(StartPoint=move_8.Geometry, EndPoint=pshift_7)  # -> simplify(graft(Line)); disabled
join_7 = JoinCurves(Curves=[line_4, ln_22], Preserve=False)  # disabled
fillet_2 = Fillet(Curve=join_7, Radius=0.125)  # -> simplify(Curve); disabled
flip_7 = FlipCurve(Curve=ext_5)  # -> Curve, Flag; disabled
flip_8 = FlipCurve(Curve=ext_4)  # -> Curve, Flag; disabled
blendc_4 = BlendCurve(CurveA=intcrv_6.Curve, CurveB=flip_6.Curve, BulgeA=1, BulgeB=1, Continuity=2)  # -> simplify(Blend); disabled
blendc_5 = BlendCurve(CurveA=flip_5.Curve, CurveB=intcrv_7.Curve, BulgeA=1, BulgeB=1, Continuity=2)  # -> simplify(Blend); disabled
pshift_8 = ShiftPaths(Data=[fillet_2, ln_18, ln_19, ln_17, move_14.Geometry], Offset=-1)  # disabled
join_8 = JoinCurves(Curves=pshift_8, Preserve=False)  # -> simplify(Curves); disabled
cir_7 = Circle(Plane=[diamondcenterpts, eval_4.Point], Radius=number_slider_24)  # -> simplify(Circle); disabled
boundary_3 = BoundarySurfaces(Edges=[join_8, cir_7])  # disabled
blendc_6 = BlendCurve(CurveA=ext_5, CurveB=flip_8.Curve, BulgeA=number_slider_25, BulgeB=number_slider_25, Continuity=2)  # -> simplify(Blend); disabled
blendc_7 = BlendCurve(CurveA=flip_7.Curve, CurveB=ext_4, BulgeA=number_slider_25, BulgeB=number_slider_25, Continuity=2)  # -> simplify(Blend); disabled
boundary_4 = BoundarySurfaces(Edges=cir_7)  # disabled
boundary_5 = BoundarySurfaces(Edges=[intcrv_6.Curve, cir_6, intcrv_7.Curve, blendc_5, blendc_4])  # disabled
pshift_9 = ShiftPaths(Data=boundary_5, Offset=-1)  # disabled
move_20 = Move(Geometry=boundary_4, Motion=vec2pt.Vector)  # -> Geometry, Transform; disabled
boundary_6 = BoundarySurfaces(Edges=[ext_5, ext_4, blendc_6, cir_4, blendc_7, cir, cir_5])  # disabled
edges_2 = BrepEdges(Brep=[boundary_3, boundary_2, pshift_9, boundary_6])  # -> Naked, Interior, NonManifold; disabled
crv_7 = Curve(edges_2.Naked)  # disabled
mesh_3 = Mesh([boundary_3, boundary_2, pshift_9, boundary_6])  # disabled
group_3 = Group(Objects=crv_7)  # disabled
preview_8 = CustomPreview(Geometry=mesh_3, Shader=swatch_2)  # disabled
pshift_10 = ShiftPaths(Data=group_3, Offset=-1)  # disabled
group_4 = Group(Objects=pshift_10)  # disabled
item_49 = ListItem(List=flatten(group_4), Index=0, Wrap=True)  # disabled
ungroup_2 = Ungroup(Group=item_49)  # disabled

# ----
# ANGLES GOING
# OUT TO ARDUINOS
# VIA SERIAL
# Angle values
# generated from
# Kinect coming in.
# Angle data going out
# to Arduino boards
addition = Addition(A=rotationangle_2, B=90)
ports_available = COMPortsAvailable()
rotationangleforarduino = Number(flatten(addition))
toggle = BooleanToggle(False)
_12 = Number(12)
_14 = Number(14)
_13 = Number(13)
open_port = OpenClosePort(OpenClosePort=toggle, PortNumber=_12, BaudRate=115200)
open_port_2 = OpenClosePort(OpenClosePort=toggle, PortNumber=_14, BaudRate=115200)
open_port_3 = OpenClosePort(OpenClosePort=toggle, PortNumber=_13, BaudRate=115200)
_30000 = Number(30000)
addition_2 = Addition(A=rotationangleforarduino, B=_30000)
round = Round(Number=addition_2)  # -> Nearest, Floor, Ceiling
split_3 = SplitList(List=round.Nearest, Index=33)  # -> ListA, ListB
split_4 = SplitList(List=split_3.ListB, Index=33)  # -> ListA, ListB
join_9 = TextJoin(Text=split_3.ListA, Join=",")  # -> simplify(flatten(Result))
join_10 = TextJoin(Text=split_4.ListB, Join=",")  # -> simplify(flatten(Result))
join_11 = TextJoin(Text=split_4.ListA, Join=",")  # -> simplify(flatten(Result))
panel_4 = Panel(join_9)
toggle_2 = BooleanToggle(True)
concat = Concatenate(FragmentA=join_11)
concat_2 = Concatenate(FragmentA=join_10)
concat_3 = Concatenate(FragmentA=join_9)
write = SerialWriteGeneric(StartWritingValues=toggle_2, WriteData=concat, PortNumber=_13)  # -> ArduinoOutput, StatusMessage
write_2 = SerialWriteGeneric(StartWritingValues=toggle_2, WriteData=concat_3, PortNumber=_12)  # -> ArduinoOutput, StatusMessage
write_3 = SerialWriteGeneric(StartWritingValues=toggle_2, WriteData=concat_2, PortNumber=_14)  # -> ArduinoOutput, StatusMessage
panel_5 = Panel(write_3.ArduinoOutput)
