# Grasshopper definition shark test.gh (Grasshopper 0.9.76)
# plug-ins: Python Interpreter

button = Button()
toggle = BooleanToggle(False)
shark_curve = Curve(<curve referenced from the Rhino model>)
shark_curve_2 = Curve(<curve referenced from the Rhino model>)
boundingcurve = Curve(<curve referenced from the Rhino model>)
boundingcurve_2 = Curve(<curve referenced from the Rhino model>)
geo = Geometry(<mesh referenced from the Rhino model>)
geo_2 = Geometry(<mesh referenced from the Rhino model>)
python = PythonScript(start=toggle, Reset=button, speed=Slider(65, range=0..1000))  # -> ElapsedTime, Foo; inputs Reset: Boolean, speed: Int32
# ---------- python: Python ----------
import time
import Grasshopper as gh
import scriptcontext as sc

STEP = sc.sticky
S = "next_step"

def updateComponent():
    
    """ Updates this component, similar to using a grasshopper timer """
    
    # Define callback action
    def callBack(e):
        ghenv.Component.ExpireSolution(False)
        
    # Get grasshopper document
    ghDoc = ghenv.Component.OnPingDocument()
    
    # Schedule this component to expire
    ghDoc.ScheduleSolution(speed,gh.Kernel.GH_Document.GH_ScheduleDelegate(callBack)) # Note that the first input here is how often to update the component (in milliseconds)


# Instantiate/reset persisent starting time variable
if "startTime" not in globals() or Reset:
    startTime = time.time()

eval_list = []
for x in range(1, 1001):
    eval_list.append((1/1000) * x)

if S not in STEP:
    STEP[S] = 0
else:
    if STEP[S] == 1000:
        STEP[S] = 1
        Foo = eval_list[STEP[S]]
    else:
        Foo = eval_list[STEP[S]]
        print Foo
        print STEP[S]
        STEP[S] += 1

# Update the component
if start:
    updateComponent()
# ---------- end python ----------
python_2 = PythonScript(start=toggle, Reset=button, speed=Slider(205, range=0..1000))  # -> ElapsedTime, Foo; inputs Reset: Boolean, speed: Int32
# ---------- python_2: Python ----------
import time
import Grasshopper as gh
import scriptcontext as sc

STEP = sc.sticky
S = "next_step"

def updateComponent():
    
    """ Updates this component, similar to using a grasshopper timer """
    
    # Define callback action
    def callBack(e):
        ghenv.Component.ExpireSolution(False)
        
    # Get grasshopper document
    ghDoc = ghenv.Component.OnPingDocument()
    
    # Schedule this component to expire
    ghDoc.ScheduleSolution(speed,gh.Kernel.GH_Document.GH_ScheduleDelegate(callBack)) # Note that the first input here is how often to update the component (in milliseconds)


# Instantiate/reset persisent starting time variable
if "startTime" not in globals() or Reset:
    startTime = time.time()

eval_list = []
for x in range(1, 1001):
    eval_list.append((1/1000) * x)

if STEP[S] == 1000:
    STEP[S] = 1
    Foo = eval_list[STEP[S]]
else:
    Foo = eval_list[STEP[S]]
    print Foo
    print STEP[S]
    STEP[S] += 1

# Update the component
if start:
    updateComponent()
# ---------- end python_2 ----------
pop2d = Populate2D(Region=boundingcurve, Count=Slider(38, range=0..100), Seed=1)
pop2d_2 = Populate2D(Region=boundingcurve_2, Count=Slider(63, range=0..100), Seed=1)
area = Area(Geometry=geo)  # -> Area, Centroid
area_2 = Area(Geometry=geo_2)  # -> Area, Centroid
panel = Panel(python.Foo)
panel_2 = Panel(python.ElapsedTime)
panel_3 = Panel(python_2.Foo)
panel_4 = Panel(python_2.ElapsedTime)
intcrv = Interpolate(Vertices=pop2d, Degree=3, Periodic=False, KnotStyle=1)  # -> Curve, Length, Domain
intcrv_2 = Interpolate(Vertices=pop2d_2, Degree=3, Periodic=False, KnotStyle=1)  # -> Curve, Length, Domain
eval = EvaluateCurve(Curve=reparameterize(intcrv.Curve), Parameter=python_2.Foo)  # -> Point, Tangent, Angle
eval_2 = EvaluateCurve(Curve=reparameterize(intcrv_2.Curve), Parameter=python.Foo)  # -> Point, Tangent, Angle
vec2pt = Vector2Pt(PointA=area.Centroid, PointB=eval.Point, Unitize=False)  # -> Vector, Length
move = Move(Geometry=shark_curve, Motion=vec2pt.Vector)  # -> Geometry, Transform
vec2pt_2 = Vector2Pt(PointA=area_2.Centroid, PointB=eval_2.Point, Unitize=False)  # -> Vector, Length
move_2 = Move(Geometry=shark_curve_2, Motion=vec2pt_2.Vector)  # -> Geometry, Transform
end = EndPoints(Curve=move.Geometry)  # -> Start, End
end_2 = EndPoints(Curve=move_2.Geometry)  # -> Start, End
move_3 = Move(Geometry=geo, Motion=vec2pt.Vector)  # -> Geometry, Transform
move_4 = Move(Geometry=geo_2, Motion=vec2pt_2.Vector)  # -> Geometry, Transform
vec2pt_3 = Vector2Pt(PointA=end.Start, PointB=end.End, Unitize=False)  # -> Vector, Length
vec2pt_4 = Vector2Pt(PointA=end_2.Start, PointB=end_2.End, Unitize=False)  # -> Vector, Length
area_3 = Area(Geometry=move_3.Geometry)  # -> Area, Centroid
area_4 = Area(Geometry=move_4.Geometry)  # -> Area, Centroid
xy = XYPlane(Origin=area_3.Centroid)
xy_2 = XYPlane(Origin=area_4.Centroid)
_2 = Number(2)
_2_2 = Number(2)
angle = Angle(VectorA=eval.Tangent, VectorB=vec2pt_3.Vector, Plane=xy)  # -> Angle, Reflex
angle_2 = Angle(VectorA=eval_2.Tangent, VectorB=vec2pt_4.Vector, Plane=xy_2)  # -> Angle, Reflex
pi = Pi(Factor=_2)
pi_2 = Pi(Factor=_2_2)
subtraction = Subtraction(A=pi, B=angle.Angle)
subtraction_2 = Subtraction(A=pi_2, B=angle_2.Angle)
rot3d = Rotate3D(Geometry=move_3.Geometry, Angle=subtraction, Center=area_3.Centroid, Axis=Vector(0, 0, 1))  # -> Geometry, Transform
rot3d_2 = Rotate3D(Geometry=move_4.Geometry, Angle=subtraction_2, Center=area_4.Centroid, Axis=Vector(0, 0, 1))  # -> Geometry, Transform
shark = Geometry(rot3d.Geometry)
shark_2 = Geometry(rot3d_2.Geometry)
